# Grasshopper definition 04-1_orientation - extended.gh (Grasshopper 1.0.7)
# Copyright: Co-de-iT
# plug-ins: Kangaroo2 Components, froGH, Human

# ---- group: Directions
# E
# N
# W
# S
# D
# U
panel = Panel("-1")
X = UnitX(Factor=1)
Y = UnitY(Factor=1)
X_2 = UnitX(Factor=panel)
Y_2 = UnitY(Factor=panel)
Z = UnitZ(Factor=panel)
Z_2 = UnitZ(Factor=1)
merge = Merge(Data1=X, Data2=Y, Data3=X_2, Data4=Y_2, Data5=Z, Data6=Z_2)

# ---- group: simple mesh box
pt = Point(Point(0, 0, 0))
# orientation
# 
# identify and recognise orientation in space
# 
# code by Alessio Erioli
# 
# v 0.1
# © a3 2021 / Creative Commons Attribution-Non Commercial-ShareAlike 4.0 International License
box = CenterBox(Base=pt, X="0.5", Y="0.5", Z="0.5")
mbox = MeshBox(Base=box, XCount="1", YCount="1", ZCount="1")

# ---- group: Direction colors
# Le componenti X, Y, Z dei vettori vengono tradotte in R, G, B rispettivamente
col = Colour(merge)

# ----
panel_2 = Panel(merge)
panel_3 = Panel(col)

# ---- group: Face direction
facen = FaceNormals(Mesh=mbox)  # -> Centers, Normals

# ---- group: Display direction
vdisex = VectorDisplayEx(Point=facen.Centers, Vector=facen.Normals, Colour=RGB(0, 0, 0), Width=2)

# ----
angle = Angle(VectorA=graft(facen.Normals), VectorB=merge)  # -> Angle, Reflex
panel_4 = Panel("""0
1
2
3
4
5""")
sort = SortList(Keys=angle.Angle, ValuesA=panel_4)  # -> Keys, ValuesA
item = ListItem(List=sort.ValuesA, Index=0, Wrap=True)
item_2 = ListItem(List=sort.Keys, Index=0, Wrap=True)

mesh = Mesh(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)
panel_5 = Panel(angle.Angle)
volume = Volume(Geometry=mesh)  # -> Volume, Centroid

# ---- group: display original mesh
preview = CustomPreview(Geometry=mesh, Material=ColourSwatch(SwatchColor=RGB(255, 255, 255)))

# ---- group: Generate all direction planes
rotations = Panel("""0
0.5*Pi
Pi
1.5*Pi""")
pl = PlaneNormal(Origin=volume.Centroid, ZAxis=merge)
prot = RotatePlane(Plane=graft(pl), Angle=rotations)

# ---- group: Arrange planes in a grid
lng = ListLength(List=merge)
lng_2 = ListLength(List=rotations)
x_offset = Panel("8")
x_spacing = Panel("6")
y_spacing = Panel("6")
series = Series(Start=x_offset, Step=x_spacing, Count=lng)
series_2 = Series(Start=0, Step=y_spacing, Count=lng_2)
X_3 = UnitX(Factor=series)
Y_3 = UnitY(Factor=series_2)
addition = Addition(A=graft(X_3), B=Y_3)
move = Move(Geometry=prot, Motion=addition)  # -> Geometry, Transform

# ----
xy = XYPlane(Origin=volume.Centroid)
panel_6 = Panel(item_2)
pshift = ShiftPaths(Data=item, Offset=-1)
panel_7 = Panel(pshift)

# ---- group: place labels
item_3 = ListItem(List=move.Geometry, Index=0, Wrap=True)
Y_4 = UnitY(Factor=Slider(-4, range=-10..0))
pt_2 = Point(item_3)
labels = Panel("""Z = X
Z = Y
Z = -X
Z = -Y
Z = -Z
Z = Z""")
addition_2 = Addition(A=pt_2, B=Y_4)
xy_2 = XYPlane(Origin=addition_2)
tag = TextTag3D(Location=xy_2, Text=graft(labels), Size="0.5", Colour=ColourSwatch(SwatchColor=RGB(0, 0, 0)), Justification=2)

# ----
deplane = DeconstructPlane(Plane=move.Geometry)  # -> Origin, XAxis, YAxis, ZAxis
orient = Orient(Geometry=mesh, Source=xy, Target=move.Geometry)  # -> Geometry, Transform
item_4 = ListItem(List=col, Index=pshift, Wrap=True)

# ---- group: explode into individual mesh faces (for display purposes only)
demesh = DeconstructMesh(Mesh=mbox)  # -> Vertices, Faces, Colours, Normals
conmesh = ConstructMesh(Vertices=demesh.Vertices, Faces=graft(demesh.Faces))
clean = CombineClean(Meshes=conmesh)  # -> flatten(Mesh)
preview_2 = CustomPreview(Geometry=clean, Material=item_4)

# ---- group: display mesh edges (with tolerance angle)
f_mmeea = MeshesExtractEdgesWithToleranceAngle(Mesh=[mesh, orient.Geometry], Angle=45)  # -> InternalEdges, NakedEdges
previewlw = CustomPreviewLineweights(Geometry=f_mmeea.InternalEdges, Shader=ColourSwatch(SwatchColor=RGB(0, 0, 0)), Absolute=False)

# ---- group: find Z axis orientation (by smallest vector angle)
angle_2 = Angle(VectorA=graft(deplane.ZAxis), VectorB=merge)  # -> Angle, Reflex
panel_8 = Panel("""0
1
2
3
4
5""")
sort_2 = SortList(Keys=angle_2.Angle, ValuesA=panel_8)  # -> Keys, ValuesA
item_5 = ListItem(List=sort_2.ValuesA, Index=0, Wrap=True)

# ---- group: display planes XYZ axis
deplane_2 = DeconstructPlane(Plane=move.Geometry)  # -> Origin, XAxis, YAxis, ZAxis
merge_2 = Merge(Data1=graft(deplane_2.XAxis), Data2=graft(deplane_2.YAxis), Data3=graft(deplane_2.ZAxis))
multiplication = Multiplication(A=merge_2, B="2.75")
merge_3 = Merge(
    Data1=ColourSwatch(SwatchColor=RGB(255, 0, 0)),
    Data2=ColourSwatch(SwatchColor=RGB(85, 255, 0)),
    Data3=ColourSwatch(SwatchColor=RGB(0, 111, 255)))
vdisex_2 = VectorDisplayEx(Point=graft(deplane_2.Origin), Vector=multiplication, Colour=merge_3, Width=2)

# ----
item_6 = ListItem(List=col, Index=item_5, Wrap=True)
pshift_2 = ShiftPaths(Data=item_6, Offset=-1)
preview_3 = CustomPreview(Geometry=orient.Geometry, Material=pshift_2)
viewer = ParamViewer(merge_2)
