# Grasshopper definition maisonnette extended.gh (Grasshopper 1.0.7)
# Copyright: Co-de-iT
# plug-ins: Assembler, Human

# ----
# RMB click > reference one geometry o reference multiple geometries
geo = Geometry()

# ----
# Handle che sembrano visivamente identiche potrebbero non esserlo: la normale potrebbe puntare all'interno della Collision Mesh.
# 
# In questi casi, potete usare il comando "Flip" in Rhino per invertire il verso della polilinea.
# Se le vostre geometrie non sono Mesh (ma, ad esempio, estrusioni o polisuperfici), referenziarle in un componente Geometry e poi attaccarlo ad un componente Mesh (come sopra).
# 
# Poi connettere l'output della Mesh al Merge.
mesh = Mesh(geo)

# ----
# Handles
# piano descritto dalla polilinea
# Il componente Display Handle visualizza la normale come una linea nera puntinata. Utilizzatelo per verificate la direzione della normale
# referenziare qui le vostre Handles
crv = Curve(<curve referenced from the Rhino model>)
# parti editabili
# bake
# preview on/off
# nel disegnare le L polylines per le Handles la sequenza dei punti è fondamentale, e deve essere fatta in modo che la normale sia sempre USCENTE relativamente alla Collision Mesh
crv_2 = Curve(<curve referenced from the Rhino model>)
# normale al piano
# 2
# 0
# 1
crv_3 = Curve(<curve referenced from the Rhino model>)
crv_4 = Curve(<curve referenced from the Rhino model>)
panel = Panel("""0
90""")
panel_2 = Panel("""0
90""")
panel_3 = Panel("""0
90""")
panel_4 = Panel("""0
90""")
handcon = ConstructHandle(Polyline=crv_2, RotationAngles=panel, Type=0, Weight=1)
handcon_2 = ConstructHandle(Polyline=crv_3, RotationAngles=panel_2, Type=0, Weight=1)
handcon_3 = ConstructHandle(Polyline=crv, RotationAngles=panel_3, Type=0, Weight=1)
handcon_4 = ConstructHandle(Polyline=crv_4, RotationAngles=panel_4, Type=0, Weight=1)
merge = Merge(Data1=handcon, Data2=handcon_2, Data3=handcon_3, Data4=handcon_4)
handdisp = DisplayHandles(Handles=merge, DisplaySize=Slider(0.355, range=0..1), absHTextSize=False)

# ----
# maisonnette extended
# 
# <description>
# 
# code by Alessio Erioli
# 
# v 0.1
# © a3 2021 / Creative Commons Attribution-Non Commercial-ShareAlike 4.0 International License
# Collision mesh (spazio occupato)
mesh_2 = Mesh(<mesh referenced from the Rhino model>)

# ----
# non modificare queste impostazioni (per ora)
volume = Volume(Geometry=mesh_2)  # -> Volume, Centroid
X = UnitX(Factor=1)

# ----
# referenziare qui le geometrie costruite (mesh)
mesh_3 = Mesh(<mesh referenced from the Rhino model>)
mesh_4 = Mesh(<mesh referenced from the Rhino model>)
mesh_5 = Mesh(<mesh referenced from the Rhino model>)

mesh_6 = Mesh(<mesh referenced from the Rhino model>)

# ----
# AssemblyObject
name = Panel("Object1")
pt = Point(Point(1, 0, 0))
pt_2 = Point(Point(0, 0, 1))
vec = Vector(pt)
crv_5 = Curve(<curve referenced from the Rhino model>)
xy = XYPlane(Origin=volume.Centroid)
merge_2 = Merge(Data1=mesh_3, Data2=mesh_4, Data3=mesh_5, Data4=mesh_6)
merge_3 = Merge(Data1="3.5", Data2=pt_2, Data3=vec, Data4=crv_5)
aocon = ConstructAssemblyObject(Name=name, CollisionMesh=mesh_2, ReferencePlane=xy, Direction=X, Weight=1, Handles=merge, ZLockAO=False)
xdcon = ConstructXData(Label="data", Data=merge_3, ReferencePlane=xy, AssemblyObjectNameReference=name)
xdcon_2 = ConstructXData(Label="actual geometry", Data=merge_2, ReferencePlane=xy, AssemblyObjectNameReference=name)
merge_4 = Merge(Data1=xdcon_2, Data2=xdcon)
panel_5 = Panel(merge_4)

# ----
# Setup
xddecon = DeconstructXData(XData=xdcon)  # -> Label, Data, ReferencePlane, AssemblyObjectNameReference
panel_6 = Panel(xddecon.Data)
merge_5 = Merge(Data1=aocon)
merge_6 = Merge(Data1=xdcon_2)
merge_7 = Merge(Data1=merge_4)

# ----
# Rules (Heuristics)
heuwri = HeuristicsWriter(AssemblyObjectsSet=merge_5, noSH=False, noSO=False, xHT=False)
pt_3 = Point(Point(0, 22.64105822, 0))
heud = HeuristicDisplay(
    OriginPoint=pt_3,
    AssemblyObjectsSet=merge_5,
    XData=merge_7,
    HeuristicsSet=heuwri,
    XSize=1.2,
    YSize=1.2,
    NRows=Slider(9, range=2..10),
    DisplayType="S-R",
    ZLockFilter=False,
    OutputType="S-R")

reset = Button()
step = Button()
target_number = Panel("1000")

# ----
# Simulate
heuset = HeuristicsSettings(HeuristicsSet=heuwri, CurrentHeuristics=0, HeuristicsMode=0, ReceiverSelectionMode=0, SenderRuleSelectionMode=0)
pt_4 = Point(Point(-75.48844058, 18.92322177, 0))
aoaengine = AssemblerEngine(
    AssemblyObjectsSet=merge_5,
    StartingPlane=pt_4,
    StartingObjectType=0,
    HeuristicsSettings=heuset,
    Go=False,
    Step=step,
    NIterations=Slider(50, range=10..100),
    TargetMaxNObjects=target_number,
    ResetSettings=False,
    Reset=reset,
    UseSupports=False,
    ZLockCheck=False)  # -> Assemblage, AssemblageCount
panel_7 = Panel(aoaengine.AssemblageCount)

# ---- group: XData - all
data = Data(merge_7)

# ---- group: XData geometry
data_2 = Data(merge_6)

# ----
aocon_2 = ConstructAssemblyObject(Weight=1, ZLockAO=False)
handcon_5 = ConstructHandle(Type=0, Weight=1)

# ----
# Post-process
# visualizzazione delle collision Meshes
# edges (bordi) delle collision Meshes
# visualizzazione delle geometrie effettive
# edges (bordi) delle geometrie effettive
aoadecon = DeconstructAssemblage(Assemblage=aoaengine.Assemblage)  # -> AssemblageObjects, AssemblageRules, ReceiverObjectsIndexes, AvailableObjectIndexes, UnreachableObjectIndexes
aoadisp = DisplayAssemblage(Assemblage=aoaengine.Assemblage, ColorsOnly=False, OutputType="Occupancy")  # -> ColoredCollisionMeshes, Edges, Colors
associate_xdata = AssociateXData(AssemblyObjects=aoadecon.AssemblageObjects, XData=merge_6)  # "AO<>XD"
panel_8 = Panel(associate_xdata)
xddecon_2 = DeconstructXData(XData=associate_xdata)  # -> Label, Data, ReferencePlane, AssemblyObjectNameReference
preview = CustomPreview(
    Geometry=aoadisp.ColoredCollisionMeshes,
    Material={diffuse=RGB(221, 160, 221), emission=RGB(66, 48, 66), shine=0.5, specular=RGB(255, 255, 255), transparency=0})  # disabled

associate_xdata_2 = AssociateXData(AssemblyObjects=aoadecon.AssemblageObjects, XData=data)  # "AO<>XD"
xddecon_3 = DeconstructXData(XData=associate_xdata_2)  # -> Label, Data, ReferencePlane, AssemblyObjectNameReference
panel_9 = Panel(xddecon_3.Data)

# ----
# Utilizzate questo componente per fare il bake su Rhino
mesh_7 = Mesh(xddecon_2.Data)

medges = MeshEdges(Mesh=mesh_7)  # -> NakedEdges, InteriorEdges, NonManifoldEdges
previewlw = CustomPreviewLineweights(Geometry=[medges.InteriorEdges, medges.NakedEdges], Shader=ColourSwatch(SwatchColor=RGB(0, 0, 0)), Absolute=False)

previewlw_2 = CustomPreviewLineweights(Geometry=aoadisp.Edges, Shader=ColourSwatch(SwatchColor=RGB(97, 97, 97)), Absolute=False)

preview_2 = CustomPreview(Geometry=mesh_7, Material=graft(aoadisp.Colors))

aodecon = DeconstructAssemblyObject(AssemblyObject=aoadecon.AssemblageObjects)  # -> Name, CollisionMesh, ReferencePlane, Direction, Weight, OccludedNeighbours, Handles, ZLock
panel_10 = Panel(aoadecon.AssemblageObjects)
aoerplane = ExtractReferencePlane(AssemblyObject=aoadecon.AssemblageObjects)
handdecon = DeconstructHandle(Handle=aodecon.Handles)  # -> SenderPlane, ReceiverPlanes, ReceiverPlanesRotations, HandleType, HandleWeight, HandleOccupancy, NeighbourObjectIndex, NeighbourHandleIndex
panel_11 = Panel(handdecon.NeighbourHandleIndex)
