# Grasshopper definition in class.gh (Grasshopper 1.0.7)
# Copyright: Co-de-iT
# plug-ins: Assembler, froGH

ao = AssemblyObject(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)
heuwri = HeuristicsWriter(AssemblyObjectsSet=ao, noSH=False, noSO=False, xHT=False)
panel = Panel(heuwri)
number_slider = Slider(1.606, range=1..3)
# <title>
# 
# <description>
# 
# code by Alessio Erioli
# 
# v 0.1
# © a3 2021 / Creative Commons Attribution-Non Commercial-ShareAlike 4.0 International License
aodecon = DeconstructAssemblyObject(AssemblyObject=ao)  # -> Name, CollisionMesh, ReferencePlane, Direction, Weight, OccludedNeighbours, Handles, ZLock
panel_2 = Panel("""9
8
12
5""")
panel_3 = Panel("3")
item = ListItem(List=heuwri, Index=panel_2, Wrap=True)
heuset = HeuristicsSettings(HeuristicsSet=item, CurrentHeuristics=0, HeuristicsMode=0, ReceiverSelectionMode=0, SenderRuleSelectionMode=0)
button = Button()
heud = HeuristicDisplay(
    OriginPoint=Point(0, 0, 0),
    AssemblyObjectsSet=ao,
    HeuristicsSet=item,
    XSize=number_slider,
    YSize=number_slider,
    NRows=Slider(6, range=1..10),
    DisplayType="AO Types",
    ZLockFilter=False)
handdisp = DisplayHandles(Handles=aodecon.Handles, absHTextSize=False)
panel_4 = Panel(item)
aoaengine = AssemblerEngine(
    AssemblyObjectsSet=ao,
    StartingPlane=PlaneXY(0, 0, 0),
    StartingObjectType=0,
    HeuristicsSettings=heuset,
    Go=False,
    Step=Button(),
    NIterations=10,
    TargetMaxNObjects=1000,
    ResetSettings=False,
    Reset=button,
    UseSupports=False,
    ZLockCheck=False)  # -> Assemblage, AssemblageCount
button_2 = Button()
f_ghfilepath = GHFilePathInfo()  # -> FileName, FilePath
aoadisp = DisplayAssemblage(Assemblage=aoaengine.Assemblage, ColorsOnly=False, OutputType="Objects")  # -> ColoredCollisionMeshes, Edges, Colors
merge = Merge(Data1="regole usate", Data2=panel_4)
panel_5 = Panel(merge)
f_str2file = SaveStringToFile(String=merge, FilePath=f_ghfilepath.FilePath, FileName="data1.txt", SaveTrigger=button)
