# Grasshopper definition class autosave.gh (Grasshopper 1.0.7)
# Copyright: Co-de-iT
# plug-ins: Assembler, Human, froGH

# ----
# RMB click > reference one geometry o reference multiple geometries
geo = Geometry()

# ----
# Handle che sembrano visivamente identiche potrebbero non esserlo: la normale potrebbe puntare all'interno della Collision Mesh.
# 
# In questi casi, potete usare il comando "Flip" in Rhino per invertire il verso della polilinea.
# Se le vostre geometrie non sono Mesh (ma, ad esempio, estrusioni o polisuperfici), referenziarle in un componente Geometry e poi attaccarlo ad un componente Mesh (come sopra).
# 
# Poi connettere l'output della Mesh al Merge.
mesh = Mesh(geo)

# ----
# Handles type 0
crv = Curve(<curve referenced from the Rhino model>)
crv_2 = Curve(<curve referenced from the Rhino model>)
crv_3 = Curve(<curve referenced from the Rhino model>)
crv_4 = Curve(<curve referenced from the Rhino model>)
panel = Panel("""0
90""")
panel_2 = Panel("""0
90""")
panel_3 = Panel("""0
90""")
panel_4 = Panel("""0
90""")
handcon = ConstructHandle(Polyline=crv_2, RotationAngles=panel, Type=0, Weight=1)
handcon_2 = ConstructHandle(Polyline=crv, RotationAngles=panel_2, Type=0, Weight=1)
handcon_3 = ConstructHandle(Polyline=crv_4, RotationAngles=panel_3, Type=0, Weight=1)
handcon_4 = ConstructHandle(Polyline=crv_3, RotationAngles=panel_4, Type=0, Weight=1)

# ----
# Handles type 1
# referenziare qui le vostre Handles
crv_5 = Curve(<curve referenced from the Rhino model>)
panel_5 = Panel("""0
180""")
handcon_5 = ConstructHandle(Polyline=crv_5, RotationAngles=panel_5, Type="1", Weight=1)

# ----
# Handles
# piano descritto dalla polilinea
# Il componente Display Handle visualizza la normale come una linea nera puntinata. Utilizzatelo per verificate la direzione della normale
# referenziare qui le vostre Handles
crv_6 = Curve(<curve referenced from the Rhino model>)
# parti editabili
# bake
# preview on/off
# nel disegnare le L polylines per le Handles la sequenza dei punti è fondamentale, e deve essere fatta in modo che la normale sia sempre USCENTE relativamente alla Collision Mesh
crv_7 = Curve(<curve referenced from the Rhino model>)
# normale al piano
# 2
# 0
# 1
crv_8 = Curve(<curve referenced from the Rhino model>)
crv_9 = Curve(<curve referenced from the Rhino model>)
panel_6 = Panel("""0
90""")
panel_7 = Panel("""0
90""")
panel_8 = Panel("""0
90""")
panel_9 = Panel("""0
90""")
handcon_6 = ConstructHandle(Polyline=crv_7, RotationAngles=panel_6, Type=0, Weight=1)
handcon_7 = ConstructHandle(Polyline=crv_8, RotationAngles=panel_7, Type=0, Weight=1)
handcon_8 = ConstructHandle(Polyline=crv_6, RotationAngles=panel_8, Type=0, Weight=1)
handcon_9 = ConstructHandle(Polyline=crv_9, RotationAngles=panel_9, Type=0, Weight=1)
merge = Merge(Data1=handcon_6, Data2=handcon_7, Data3=handcon_8, Data4=handcon_9)
handdisp = DisplayHandles(Handles=merge, DisplaySize=Slider(0.355, range=0..1), absHTextSize=False)

# ----
# Collision mesh (spazio occupato)
mesh_2 = Mesh(<mesh referenced from the Rhino model>)

# ----
# maisonnette extended
# 
# <description>
# 
# code by Alessio Erioli
# 
# v 0.1
# © a3 2021 / Creative Commons Attribution-Non Commercial-ShareAlike 4.0 International License
# Collision mesh (spazio occupato)
mesh_3 = Mesh(<mesh referenced from the Rhino model>)

# ----
# non modificare queste impostazioni (per ora)
volume = Volume(Geometry=mesh_2)  # -> Volume, Centroid
X = UnitX(Factor=1)

# ----
# non modificare queste impostazioni (per ora)
volume_2 = Volume(Geometry=mesh_3)  # -> Volume, Centroid
X_2 = UnitX(Factor=1)

# ----
# referenziare qui le geometrie costruite (mesh)
mesh_4 = Mesh(<mesh referenced from the Rhino model>)
mesh_5 = Mesh(<mesh referenced from the Rhino model>)
mesh_6 = Mesh(<mesh referenced from the Rhino model>)

mesh_7 = Mesh(<mesh referenced from the Rhino model>)

# ----
# referenziare qui le geometrie costruite (mesh)
mesh_8 = Mesh(<mesh referenced from the Rhino model>)
mesh_9 = Mesh(<mesh referenced from the Rhino model>)
mesh_10 = Mesh(<mesh referenced from the Rhino model>)

mesh_11 = Mesh(<mesh referenced from the Rhino model>)

# ----
# AssemblyObject 1
name = Panel("Object1")
pt = Point(Point(1, 0, 0))
pt_2 = Point(Point(0, 0, 1))
vec = Vector(pt)
crv_10 = Curve(<curve referenced from the Rhino model>)
xy = XYPlane(Origin=volume_2.Centroid)
merge_2 = Merge(Data1=mesh_8, Data2=mesh_9, Data3=mesh_10, Data4=mesh_11)
merge_3 = Merge(Data1="3.5", Data2=pt_2, Data3=vec, Data4=crv_10)
aocon = ConstructAssemblyObject(Name=name, CollisionMesh=mesh_3, ReferencePlane=xy, Direction=X_2, Weight=1, Handles=merge, ZLockAO=False)
xdcon = ConstructXData(Label="data", Data=merge_3, ReferencePlane=xy, AssemblyObjectNameReference=name)
xdcon_2 = ConstructXData(Label="actual geometry", Data=merge_2, ReferencePlane=xy, AssemblyObjectNameReference=name)
merge_4 = Merge(Data1=xdcon_2, Data2=xdcon)
panel_10 = Panel(merge_4)

# ----
# obstacles
mesh_12 = Mesh(<mesh referenced from the Rhino model>)
mesh_13 = Mesh(<mesh referenced from the Rhino model>)
mesh_14 = Mesh(<mesh referenced from the Rhino model>)

# ----
# voids
# referenziare qui le mesh dell'ambiente (ostacoli, vuoti)
mesh_15 = Mesh(<mesh referenced from the Rhino model>)

# ----
# Environment
merge_5 = Merge(Data1=mesh_12, Data2=mesh_13, Data3=mesh_14, Data4=mesh_15)

sender_selection_mode = ValueList({"Random": 0, "Scalar Field nearest": 1, "Scalar Field interpolated": 2, "Vector Field > nearest": 3, "Vector Field > interpolated": 4, "Vector Field <> nearest": 5, "Vector Field <> interpolated": 6, "Minimum local AABB volume": 7, "Minimum local AABB diagonal": 8, "Weighted Random Choice": 9}, selected="Vector Field <> interpolated")
receiver_selection_mode = ValueList({"Random": 0, "Scalar Field nearest": 1, "Scalar Field interpolated": 2, "Dense Packing": 3}, selected="Scalar Field nearest")

# ---- group: clash lines
crv_11 = Curve([<curve referenced from the Rhino model> x6])
line = Line(crv_11)

# ---- group: selective geometry - stair
mesh_16 = Mesh(<mesh referenced from the Rhino model>)

# ---- group: reference plane
pln = Plane(xy)

# ----
field_scalar_threshold = Slider(0.198, range=0..1)

step = Button()
go = BooleanToggle(False)
target_number = Panel("1000")

f_ghfilepath = GHFilePathInfo()  # -> FileName, FilePath
panel_11 = Panel(f_ghfilepath.FilePath)
concat = Concatenate(FragmentA=panel_11, FragmentB="test_assemblage_000_d.JSON")
json_ao = AssemblyObjectsFromJSON(FilePath=concat)
panel_12 = Panel(concat)
pt_3 = Point(Point(-66.63292772, 62.94409835, -73.070624))
pt_4 = Point(Point(-107.6046796, 64.66055768, -73.070624))

# ----
# AssemblyObject 2
number_slider = Slider(0.355, range=0..1)
merge_6 = Merge(Data1=handcon_2, Data2=handcon_3, Data3=handcon_4, Data4=handcon, Data5=handcon_5)
handdisp_2 = DisplayHandles(Handles=merge_6, DisplaySize=number_slider, absHTextSize=False)
name_2 = Panel("Object2")
xy_2 = XYPlane(Origin=volume.Centroid)
merge_7 = Merge(Data1=mesh_4, Data2=mesh_5)
aocon_2 = ConstructAssemblyObject(Name=name_2, CollisionMesh=mesh_2, ReferencePlane=xy_2, Direction=X, Weight=1, Handles=merge_6, ZLockAO=False)
xdcon_3 = ConstructXData(Label="geometry H", Data=merge_7, ReferencePlane=xy_2, AssemblyObjectNameReference=name_2)

# ----
# Field
number_slider_2 = Slider(20, range=10..20)
mesh_17 = Mesh(<mesh referenced from the Rhino model>)
afieldn = ConstructFieldN(Geometry=mesh_17, Plane=PlaneXY(0, 0, 0), NCells=number_slider_2)  # -> Field, FieldPoints
merge_8 = Merge(Data1=ColourSwatch(SwatchColor=RGB(255, 255, 255)), Data2=ColourSwatch(SwatchColor=RGB(0, 0, 0)))

# ---- group: compute vector values
number_slider_3 = Slider(90.446, range=0..100)
pdecon = Deconstruct(Point=afieldn.FieldPoints)  # -> XComponent, YComponent, ZComponent
larger = LargerThan(FirstNumber=pdecon.YComponent, SecondNumber=number_slider_3)  # -> LargerThan, OrEqualTo
Z = UnitZ(Factor=1)
Y = UnitY(Factor=1)
weave = Weave(Pattern=graft(larger.LargerThan), Stream0=Y, Stream1=Z, NullGaps=False)  # -> flatten(Weave)

# ---- group: compute scalar values
crv_12 = Curve(<curve referenced from the Rhino model>)
crv_cp = CurveClosestPoint(Point=afieldn.FieldPoints, Curve=crv_12)  # -> Point, Parameter, Distance

# ---- group: display threshold
pt_5 = ConstructPoint(XCoordinate=0, YCoordinate=number_slider_3, ZCoordinate=0)
xz = XZPlane(Origin=pt_5)
sec = MeshPlane(Mesh=mesh_17, Plane=xz)
previewlw = CustomPreviewLineweights(Geometry=sec, Shader=ColourSwatch(SwatchColor=RGB(255, 0, 0)), Thickness="3", Absolute=False)

# ----
afpop = PopulateField(Field=afieldn.Field, ScalarValues=crv_cp.Distance, VectorValues=weave)
afcol = ColorField(Field=afpop, Colors=merge_8, Index=0, Threshold=field_scalar_threshold, FieldColorBlend=False)  # -> Field, Colors
afdecon = DeconstructField(Field=afcol.Field)  # -> Points, ScalarValues, flatten(Vectors), IWeights, Colors, Topology, TopologyWeights
multiplication = Multiplication(A=afdecon.Vectors, B=Slider(3.63, range=1..5))
vdisex = VectorDisplayEx(Point=afdecon.Points, Vector=multiplication, Colour=afdecon.Vectors, Width=2)

# ----
# Setup
mesh_18 = Mesh(<mesh referenced from the Rhino model>)
merge_9 = Merge(Data1=aocon, Data2=aocon_2)

merge_10 = Merge(Data1=mesh_6, Data2=mesh_18, Data3=mesh_7)

xdcon_4 = ConstructXData(Label="geometry V", Data=merge_10, ReferencePlane=xy_2, AssemblyObjectNameReference=name_2)

merge_11 = Merge(Data1=xdcon_3, Data2=xdcon_4)

merge_12 = Merge(Data1=xdcon_2, Data2=merge_11)
merge_13 = Merge(Data1=merge_4, Data2=merge_11)

# ----
# Rules (Heuristics)
heuwri = HeuristicsWriter(AssemblyObjectsSet=merge_9, noSH=False, noSO=False, xHT=False)
pt_6 = Point(Point(0, 22.64105822, 0))
heud = HeuristicDisplay(
    OriginPoint=pt_6,
    AssemblyObjectsSet=merge_9,
    XData=merge_13,
    HeuristicsSet=heuwri,
    XSize=1.2,
    YSize=1.2,
    NRows=Slider(10, range=2..10),
    DisplayType="S-R",
    ZLockFilter=False,
    OutputType="S-R")

# ----
# Simulate
panel_13 = Panel("2")
heuset = HeuristicsSettings(
    HeuristicsSet=heuwri,
    CurrentHeuristics=0,
    HeuristicsMode=0,
    ReceiverSelectionMode=receiver_selection_mode,
    SenderRuleSelectionMode=sender_selection_mode)
exoset = ExogenousSettings(
    EnvironmentMeshes=merge_5,
    EnvironmentMode=panel_13,
    Field=afcol.Field,
    FieldScalarThreshold=field_scalar_threshold,
    Sandbox={Plane=PlaneXY(0, 0, 0), X=Domain(-1, 1), Y=Domain(0, 0), Z=Domain(0, 0)},
    HasContainer=False)
reset_settings = Button()
reset = Button()
pt_7 = Point(Point(-75.48844058, 18.92322177, 0))
aoaengine = AssemblerEngine(
    AssemblyObjectsSet=merge_9,
    StartingPlane=pt_7,
    StartingObjectType=0,
    HeuristicsSettings=heuset,
    ExogenousSettings=exoset,
    Go=go,
    Step=step,
    NIterations=Slider(100, range=10..100),
    TargetMaxNObjects=target_number,
    ResetSettings=reset_settings,
    Reset=reset,
    UseSupports=False,
    ZLockCheck=False)  # -> Assemblage, AssemblageCount
panel_14 = Panel(aoaengine.AssemblageCount)

# ---- group: autostop condition
larger_2 = LargerThan(FirstNumber=aoaengine.AssemblageCount, SecondNumber=target_number)  # -> LargerThan, OrEqualTo
f_tas = ToggleAutostop(Toggle=go, Condition=larger_2.OrEqualTo)

# ----
data = Data(aoaengine.Assemblage)

# ---- group: XData - all
data_2 = Data(merge_13)

# ---- group: XData geometry
data_3 = Data(merge_12)

# ----
# Display
aoadisp = DisplayAssemblage(Assemblage=data, ColorsOnly=False, OutputType="Occupancy")  # -> ColoredCollisionMeshes, Edges, Colors

previewlw_2 = CustomPreviewLineweights(Geometry=aoadisp.Edges, Shader=ColourSwatch(SwatchColor=RGB(97, 97, 97)), Absolute=False)

# ----
# Collision meshes
preview = CustomPreview(
    Geometry=aoadisp.ColoredCollisionMeshes,
    Material={diffuse=RGB(221, 160, 221), emission=RGB(66, 48, 66), shine=0.5, specular=RGB(255, 255, 255), transparency=0})  # disabled

# ----
# Post-process
aoadecon = DeconstructAssemblage(Assemblage=data)  # -> AssemblageObjects, AssemblageRules, ReceiverObjectsIndexes, AvailableObjectIndexes, UnreachableObjectIndexes
associate_xdata = AssociateXData(AssemblyObjects=aoadecon.AssemblageObjects, XData=merge_12)  # "AO<>XD"

ao_json = AssemblyObjectsToJSON(
    AssemblyObjects=flatten(aoadecon.AssemblageObjects),
    Directory=f_ghfilepath.FilePath,
    FileName="test_assemblage",
    Save=Toggle(False))

# ----
# identify type 1 Horizontal-Vertical
data_4 = Data(aoadecon.AssemblageObjects)

dam = DataDam(DataA=data_4, BufferDelay=10000000, BufferMode=0)

# ---- group: identify type
aoetype = ExtractType(AssemblyObject=dam)
equals = Equality(FirstNumber=aoetype, SecondNumber="0")  # -> Equality, Inequality

aoetype_2 = ExtractType(AssemblyObject=data_4)
equals_2 = Equality(FirstNumber=aoetype_2, SecondNumber="1")  # -> Equality, Inequality

# ----
# 1st selection filter
cull = CullPattern(List=dam, CullPattern=equals.Equality)

# ---- group: separate types
dispatch = Dispatch(List=data_4, DispatchPattern=equals_2.Equality)  # -> ListA, ListB

# ---- group: identify horizontal alignment
aoerplane = ExtractReferencePlane(AssemblyObject=cull)
deplane = DeconstructPlane(Plane=aoerplane)  # -> Origin, XAxis, YAxis, ZAxis
Z_2 = UnitZ(Factor=1)
dprod = DotProduct(VectorA=deplane.ZAxis, VectorB=Z_2, Unitize=False)
similar = Similarity(FirstNumber=dprod, SecondNumber="1", Threshold=0.1)  # -> Similarity, AbsoluteDifference

# ---- group: identify horizontal-vertical alignment
aoerplane_2 = ExtractReferencePlane(AssemblyObject=dispatch.ListA)
deplane_2 = DeconstructPlane(Plane=aoerplane_2)  # -> Origin, XAxis, YAxis, ZAxis
Z_3 = UnitZ(Factor=1)
dprod_2 = DotProduct(VectorA=deplane_2.XAxis, VectorB=Z_3, Unitize=False)
abs = Absolute(Value=dprod_2)

# ----
lng = ListLength(List=dispatch.ListB)
repeat = RepeatData(Data="0", Length=lng)

# ----
# 2nd selection filter
cull_2 = CullPattern(List=cull, CullPattern=similar.Similarity)

# ---- group: regroup types
weave_2 = Weave(Pattern=equals_2.Equality, Stream0=repeat, Stream1=abs, NullGaps=False)

# ----
item = ListItem(List=associate_xdata, Index=weave_2, Wrap=True)

xddecon = DeconstructXData(XData=item)  # -> Label, Data, ReferencePlane, AssemblyObjectNameReference

# ----
# Utilizzate questo componente per fare il bake su Rhino
mesh_19 = Mesh(xddecon.Data)

medges = MeshEdges(Mesh=mesh_19)  # -> NakedEdges, InteriorEdges, NonManifoldEdges
previewlw_3 = CustomPreviewLineweights(Geometry=[medges.InteriorEdges, medges.NakedEdges], Shader=ColourSwatch(SwatchColor=RGB(0, 0, 0)), Absolute=False)

# ----
# Actual geometries
preview_2 = CustomPreview(Geometry=mesh_19, Material=graft(aoadisp.Colors))

# ---- group: filter within distance
aoerplane_3 = ExtractReferencePlane(AssemblyObject=cull_2)
distance_threshold = Slider(20.361, range=1..100)
pt_8 = Point(Point(-96.46278039, 16.86835508, -73.070624))
project = Project(Geometry=aoerplane_3, Plane=pt_8)  # -> Geometry, Transform
dist = Distance(PointA=project.Geometry, PointB=pt_8)

# ----
merge_14 = Merge(Data1=pt_8, Data2=pt_3, Data3=pt_4)
pull = PullPoint(Point=project.Geometry, Geometry=merge_14, ClosestOnly=True)  # -> ClosestPoint, Distance

# ---- group: filter within distance (continued)
smaller = SmallerThan(FirstNumber=pull.Distance, SecondNumber=distance_threshold)  # -> SmallerThan, OrEqualTo
cull_3 = CullPattern(List=cull_2, CullPattern=smaller.SmallerThan)

# ----
cull_4 = CullPattern(List=project.Geometry, CullPattern=smaller.SmallerThan)

# ----
# controlla se le clash lines si scontrano con la geometria effettiva
aoerplane_4 = ExtractReferencePlane(AssemblyObject=cull_3)
mesh_20 = Mesh(xddecon.Data)
mjoin = MeshJoin(Meshes=flatten(mesh_20))
orient = Orient(Geometry=line, Source=pln, Target=aoerplane_4)  # -> Geometry, Transform
mcx = MeshCurve(Mesh=mjoin, Curve=orient.Geometry)  # -> Points, Faces

pshift = ShiftPaths(Data=mcx.Points, Offset=-1)
lng_2 = ListLength(List=pshift)
equals_3 = Equality(FirstNumber=lng_2, SecondNumber="0")  # -> Equality, Inequality
cull_5 = CullPattern(List=cull_3, CullPattern=equals_3.Equality)
aoerplane_5 = ExtractReferencePlane(AssemblyObject=cull_5)
orient_2 = Orient(Geometry=mesh_16, Source=pln, Target=flatten(aoerplane_5))  # -> Geometry, Transform
medges_2 = MeshEdges(Mesh=orient_2.Geometry)  # -> NakedEdges, InteriorEdges, NonManifoldEdges
preview_3 = CustomPreview(Geometry=orient_2.Geometry, Material=graft(ColourSwatch(SwatchColor=RGB(0, 229, 255))))
previewlw_4 = CustomPreviewLineweights(Geometry=[medges_2.InteriorEdges, medges_2.NakedEdges], Shader=ColourSwatch(SwatchColor=RGB(0, 0, 0)), Absolute=False)
