# Grasshopper definition maisonnette extended - multiple AO_E-F-H-V_heuristics.gh (Grasshopper 1.0.7)
# Copyright: Co-de-iT
# plug-ins: Assembler, Human, froGH

# ----
# Handles
# piano descritto dalla polilinea
# Il componente Display Handle visualizza la normale come una linea nera puntinata. Utilizzatelo per verificate la direzione della normale
# referenziare qui le vostre Handles
crv = Curve(<curve referenced from the Rhino model>)
# parti editabili
# bake
# preview on/off
# nel disegnare le L polylines per le Handles la sequenza dei punti è fondamentale, e deve essere fatta in modo che la normale sia sempre USCENTE relativamente alla Collision Mesh
crv_2 = Curve(<curve referenced from the Rhino model>)
# normale al piano
# 2
# 0
# 1
crv_3 = Curve(<curve referenced from the Rhino model>)
# Handle che sembrano visivamente identiche potrebbero non esserlo: la normale potrebbe puntare all'interno della Collision Mesh.
# 
# In questi casi, potete usare il comando "Flip" in Rhino per invertire il verso della polilinea.
crv_4 = Curve(<curve referenced from the Rhino model>)
panel = Panel("""0
90""")
panel_2 = Panel("""0
90""")
panel_3 = Panel("""0
90""")
panel_4 = Panel("""0
90""")
handcon = ConstructHandle(Polyline=crv_2, RotationAngles=panel, Type=0, Weight=1)
handcon_2 = ConstructHandle(Polyline=crv_3, RotationAngles=panel_2, Type=0, Weight=1)
handcon_3 = ConstructHandle(Polyline=crv, RotationAngles=panel_3, Type=0, Weight=1)
handcon_4 = ConstructHandle(Polyline=crv_4, RotationAngles=panel_4, Type=0, Weight=1)
merge = Merge(Data1=handcon, Data2=handcon_2, Data3=handcon_3, Data4=handcon_4)
handdisp = DisplayHandles(Handles=merge, DisplaySize=Slider(0.355, range=0..1), absHTextSize=False)

# ----
# Handles type 0
crv_5 = Curve(<curve referenced from the Rhino model>)
crv_6 = Curve(<curve referenced from the Rhino model>)
crv_7 = Curve(<curve referenced from the Rhino model>)
crv_8 = Curve(<curve referenced from the Rhino model>)
panel_5 = Panel("""0
90""")
panel_6 = Panel("""0
90""")
panel_7 = Panel("""0
90""")
panel_8 = Panel("""0
90""")
handcon_5 = ConstructHandle(Polyline=crv_6, RotationAngles=panel_5, Type=0, Weight=1)
handcon_6 = ConstructHandle(Polyline=crv_5, RotationAngles=panel_6, Type=0, Weight=1)
handcon_7 = ConstructHandle(Polyline=crv_8, RotationAngles=panel_7, Type=0, Weight=1)
handcon_8 = ConstructHandle(Polyline=crv_7, RotationAngles=panel_8, Type=0, Weight=1)

# ----
# Handles type 1
# referenziare qui le vostre Handles
panel_9 = Panel("""0
180""")
crv_9 = Curve(<curve referenced from the Rhino model>)
handcon_9 = ConstructHandle(Polyline=crv_9, RotationAngles=panel_9, Type="1", Weight=1)

# ----
# maisonnette extended
# 
# <description>
# 
# code by Alessio Erioli
# 
# v 0.1
# © a3 2021 / Creative Commons Attribution-Non Commercial-ShareAlike 4.0 International License
# Collision mesh (spazio occupato)
mesh = Mesh(<mesh referenced from the Rhino model>)

# ----
# Collision mesh (spazio occupato)
mesh_2 = Mesh(<mesh referenced from the Rhino model>)

# ----
# non modificare queste impostazioni (per ora)
volume = Volume(Geometry=mesh)  # -> Volume, Centroid
X = UnitX(Factor=1)

# ----
# non modificare queste impostazioni (per ora)
volume_2 = Volume(Geometry=mesh_2)  # -> Volume, Centroid
X_2 = UnitX(Factor=1)

# ----
# referenziare qui le geometrie costruite (mesh)
mesh_3 = Mesh(<mesh referenced from the Rhino model>)
mesh_4 = Mesh(<mesh referenced from the Rhino model>)
mesh_5 = Mesh(<mesh referenced from the Rhino model>)

mesh_6 = Mesh(<mesh referenced from the Rhino model>)

# ----
# AssemblyObject A
name = Panel("ObjectA")
xy = XYPlane(Origin=volume.Centroid)
merge_2 = Merge(Data1=mesh_3, Data2=mesh_4, Data3=mesh_5, Data4=mesh_6)
aocon = ConstructAssemblyObject(Name=name, CollisionMesh=mesh, ReferencePlane=xy, Direction=X, Handles=merge, Weight=1, ZLockAO=False)
xdcon = ConstructXData(Label="actual geometry", AssemblyObject=aocon, Data=merge_2)

# ----
# referenziare qui le geometrie costruite (mesh)
mesh_7 = Mesh(<mesh referenced from the Rhino model>)
mesh_8 = Mesh(<mesh referenced from the Rhino model>)
mesh_9 = Mesh(<mesh referenced from the Rhino model>)
mesh_10 = Mesh(<mesh referenced from the Rhino model>)
mesh_11 = Mesh(<mesh referenced from the Rhino model>)

# ----
# AssemblyObject B
number_slider = Slider(0.355, range=0..1)
merge_3 = Merge(Data1=handcon_6, Data2=handcon_7, Data3=handcon_8, Data4=handcon_5, Data5=handcon_9)
handdisp_2 = DisplayHandles(Handles=merge_3, DisplaySize=number_slider, absHTextSize=False)
name_2 = Panel("ObjectB")
xy_2 = XYPlane(Origin=volume_2.Centroid)
merge_4 = Merge(Data1=mesh_9, Data2=mesh_10)
merge_5 = Merge(Data1=mesh_11, Data2=mesh_8, Data3=mesh_7)
aocon_2 = ConstructAssemblyObject(Name=name_2, CollisionMesh=mesh_2, ReferencePlane=xy_2, Direction=X_2, Handles=merge_3, Weight=1, ZLockAO=False)
xdcon_2 = ConstructXData(Label="geometry H", AssemblyObject=aocon_2, Data=merge_4)
xdcon_3 = ConstructXData(Label="geometry V", AssemblyObject=aocon_2, Data=merge_5)

# ---- group: wall
crv_10 = Curve(<curve referenced from the Rhino model>)

# ---- group: cp H
crv_11 = Curve([<curve referenced from the Rhino model> x7])

# ---- group: cp V
crv_12 = Curve([<curve referenced from the Rhino model> x8])

# ----
xdcon_4 = ConstructXData(Label="circulation path H", AssemblyObject=aocon_2, Data=crv_11)
xdcon_5 = ConstructXData(Label="circulation path V", AssemblyObject=aocon_2, Data=crv_12)

# ---- group: stair
crv_13 = Curve([<curve referenced from the Rhino model> x3])

# ----
crv_14 = Curve([<curve referenced from the Rhino model> x12])
merge_6 = Merge(Data1=crv_14)
xdcon_6 = ConstructXData(Label="circulation path stair", AssemblyObject=aocon, Data=crv_13)
xdcon_7 = ConstructXData(Label="circulation path", AssemblyObject=aocon, Data=merge_6)

# ---- group: OLD
aocon_3 = ConstructAssemblyObject(Weight=1, ZLockAO=False)  # disabled

xdcon_8 = ConstructXData()  # disabled

# ----
merge_7 = Merge(Data1=xdcon_2, Data2=xdcon_3)
merge_8 = Merge(Data1=xdcon_4, Data2=xdcon_5)

# ----
# Setup
merge_9 = Merge(Data1=aocon, Data2=aocon_2)
merge_10 = Merge(Data1=xdcon_7, Data2=merge_8)
merge_11 = Merge(Data1=xdcon, Data2=merge_7)

# ----
# obstacles
mesh_12 = Mesh(<mesh referenced from the Rhino model>)
mesh_13 = Mesh(<mesh referenced from the Rhino model>)
mesh_14 = Mesh(<mesh referenced from the Rhino model>)

# ----
# voids
# referenziare qui le mesh dell'ambiente (ostacoli, vuoti)
mesh_15 = Mesh(<mesh referenced from the Rhino model>)

merge_12 = Merge(Data1=merge_11, Data2=merge_10)

# ----
# Rules (Heuristics)
heuwri = HeuristicsWriter(AssemblyObjectsSet=merge_9, noSH=False, noSO=False, xHT=False)
pt = Point(Point(0, 22.64105822, 0))
heud = HeuristicDisplay(
    OriginPoint=pt,
    AssemblyObjectsSet=merge_9,
    XData=merge_12,
    HeuristicsSet=heuwri,
    XSize=1.2,
    YSize=1.2,
    NRows=Slider(10, range=2..10),
    DisplayType="S-R",
    ZLockFilter=False,
    OutputType="S-R")

# ----
# Separating rules by Object Kind
panel_10 = Panel("<|")
panel_11 = Panel(heuwri)
split = TextSplit(Text=heuwri, Separators=panel_10)
panel_12 = Panel("""0
2""")
panel_13 = Panel("\"Object\" = 5 caratteri")
item = ListItem(List=split, Index=panel_12, Wrap=True)
panel_14 = Panel(item)
fragment = TextFragment(Text=item, Start="6")
join = TextJoin(Text=fragment)
panel_15 = Panel("""AA
BB
AB
BA""")
mindex = MemberIndex(Set=flatten(join), Member=panel_15)  # -> Index, Count
panel_16 = Panel(join)
item_2 = ListItem(List=heuwri, Index=mindex.Index, Wrap=True)
bang = ExplodeTree(Data=item_2)  # -> Branch0, Branch1, Branch2, Branch3
merge_13 = Merge(Data1=bang.Branch2, Data2=bang.Branch3)  # -> flatten(Result)
entwine = Entwine(Branch00=bang.Branch0, Branch01=merge_13, Branch02=bang.Branch1, FlattenInputs=True)

# ----
# Environment
merge_14 = Merge(Data1=mesh_12, Data2=mesh_13, Data3=mesh_14, Data4=mesh_15)

sender_selection_mode = ValueList({"Random": 0, "Scalar Field nearest": 1, "Scalar Field interpolated": 2, "Vector Field > nearest": 3, "Vector Field > interpolated": 4, "Vector Field <> nearest": 5, "Vector Field <> interpolated": 6, "Minimum local AABB volume": 7, "Minimum local AABB diagonal": 8, "Weighted Random Choice": 9}, selected="Vector Field <> interpolated")
receiver_selection_mode = ValueList({"Random": 0, "Scalar Field nearest": 1, "Scalar Field interpolated": 2, "Dense Packing": 3}, selected="Scalar Field nearest")

# ---- group: clash lines
crv_15 = Curve([<curve referenced from the Rhino model> x6])
line = Line(crv_15)

# ---- group: selective geometry - stair
mesh_16 = Mesh(<mesh referenced from the Rhino model>)

# ---- group: reference plane
pln = Plane(xy)

# ----
heuristics_mode = ValueList({"Manual": 0, "Field Driven": 1}, selected="Field Driven")
field_scalar_threshold = Slider(0.198, range=0..1)

step = Button()
go = BooleanToggle(False)
target_number = Panel("2000")

# ---- group: filter within distance
aos = Relay()
aoerplane = ExtractReferencePlane(AssemblyObject=aos)
distance_threshold = Slider(23.708, range=1..100)
pt_2 = Point(Point(-109.082227, 5.769564398, -52.52912492))
project = Project(Geometry=aoerplane, Plane=pt_2)  # -> Geometry, Transform
dist = Distance(PointA=project.Geometry, PointB=pt_2)
smaller = SmallerThan(FirstNumber=dist, SecondNumber=distance_threshold)  # -> SmallerThan, OrEqualTo
cull = CullPattern(List=project.Geometry, CullPattern=smaller.SmallerThan)

# ---- group: OLD
xddecon = DeconstructXData()  # -> Label, Data, ReferencePlane, AssemblyObjectNameReference; disabled

# ----
# Field
number_slider_2 = Slider(20, range=10..20)
mesh_17 = Mesh(<mesh referenced from the Rhino model>)
afieldn = ConstructFieldN(Geometry=mesh_17, Plane=PlaneXY(0, 0, 0), NCells=number_slider_2)  # -> Field, FieldPoints
merge_15 = Merge(Data1=ColourSwatch(SwatchColor=RGB(255, 255, 255)), Data2=ColourSwatch(SwatchColor=RGB(0, 0, 0)))
merge_16 = Merge(
    Data1=ColourSwatch(SwatchColor=RGB(255, 0, 0)),
    Data2=ColourSwatch(SwatchColor=RGB(214, 214, 214)),
    Data3=ColourSwatch(SwatchColor=RGB(22, 196, 16)))

# ---- group: compute vector values
number_slider_3 = Slider(90.446, range=0..100)
pdecon = Deconstruct(Point=afieldn.FieldPoints)  # -> XComponent, YComponent, ZComponent
larger = LargerThan(FirstNumber=pdecon.YComponent, SecondNumber=number_slider_3)  # -> LargerThan, OrEqualTo
Z = UnitZ(Factor=1)
Y = UnitY(Factor=1)
weave = Weave(Pattern=graft(larger.LargerThan), Stream0=Y, Stream1=Z, NullGaps=False)  # -> flatten(Weave)

# ---- group: compute scalar values
crv_16 = Curve(<curve referenced from the Rhino model>)
crv_cp = CurveClosestPoint(Point=afieldn.FieldPoints, Curve=crv_16)  # -> Point, Parameter, Distance

# ---- group: compute iWeights
num = Number(pdecon.YComponent)
bnd = Bounds(Numbers=num)
div = DivideDomain(Domain=bnd, Count="3")
fdom = FindDomain(Domains=div, Number=num, Strict=False)  # -> Index, Neighbour

# ---- group: display threshold
pt_3 = ConstructPoint(XCoordinate=0, YCoordinate=number_slider_3, ZCoordinate=0)
xz = XZPlane(Origin=pt_3)
sec = MeshPlane(Mesh=mesh_17, Plane=xz)
previewlw = CustomPreviewLineweights(Geometry=sec, Shader=ColourSwatch(SwatchColor=RGB(255, 0, 0)), Thickness="3", Absolute=False)

# ----
afpop = PopulateField(Field=afieldn.Field, ScalarValues=crv_cp.Distance, VectorValues=weave, IWeightValues=fdom.Index)
afcol = ColorField(Field=afpop, Colors=merge_15, Index=0, Threshold=field_scalar_threshold, FieldColorBlend=False)  # -> Field, Colors
afdecon = DeconstructField(Field=afcol.Field)  # -> Points, ScalarValues, flatten(Vectors), flatten(IWeights), Colors, Topology, TopologyWeights
item_3 = ListItem(List=merge_16, Index=fdom.Index, Wrap=True)
multiplication = Multiplication(A=afdecon.Vectors, B=Slider(3.63, range=1..5))
tag = TextTag3D(Location=afdecon.Points, Text=afdecon.IWeights, Size=Slider(3, range=1..3), Colour=item_3, Justification=7)
vdisex = VectorDisplayEx(Point=afdecon.Points, Vector=multiplication, Colour=afdecon.Vectors, Width=2)

# ----
# Simulate
panel_17 = Panel("2")
heuset = HeuristicsSettings(
    HeuristicsSet=entwine,
    CurrentHeuristics=0,
    HeuristicsMode=heuristics_mode,
    ReceiverSelectionMode=receiver_selection_mode,
    SenderRuleSelectionMode=sender_selection_mode)
exoset = ExogenousSettings(
    EnvironmentMeshes=merge_14,
    EnvironmentMode=panel_17,
    Field=afcol.Field,
    FieldScalarThreshold=field_scalar_threshold,
    Sandbox={Plane=PlaneXY(0, 0, 0), X=Domain(-1, 1), Y=Domain(0, 0), Z=Domain(0, 0)},
    HasContainer=False)
reset_settings = Button()
reset = Button()
pt_4 = Point(Point(-75.48844058, 18.92322177, 0))
aoaengine = AssemblerEngine(
    AssemblyObjectsSet=merge_9,
    StartingPlane=pt_4,
    StartingObjectType=0,
    HeuristicsSettings=heuset,
    ExogenousSettings=exoset,
    Go=go,
    Step=step,
    NIterations=Slider(100, range=10..100),
    TargetMaxNObjects=target_number,
    ResetSettings=reset_settings,
    Reset=reset,
    UseSupports=False,
    ZLockCheck=False)  # -> Assemblage, AssemblageCount
panel_18 = Panel(aoaengine.AssemblageCount)

# ---- group: autostop condition
larger_2 = LargerThan(FirstNumber=aoaengine.AssemblageCount, SecondNumber=target_number)  # -> LargerThan, OrEqualTo
f_tas = ToggleAutostop(Toggle=go, Condition=larger_2.OrEqualTo)

# ----
data = Data(aoaengine.Assemblage)

# ----
# Post-process
aoadecon = DeconstructAssemblage(Assemblage=data)  # -> AssemblageObjects, AssemblageRules, ReceiverObjectsIndexes, AvailableObjectIndexes, UnreachableObjectIndexes
associate_xdata = AssociateXData(AssemblyObjects=aoadecon.AssemblageObjects, XData=merge_11)  # "AO<>XD"

# ----
# Display
aoadisp = DisplayAssemblage(Assemblage=data, ColorsOnly=False, OutputType="AO Types")  # -> ColoredCollisionMeshes, Edges, Colors

previewlw_2 = CustomPreviewLineweights(Geometry=aoadisp.Edges, Shader=ColourSwatch(SwatchColor=RGB(97, 97, 97)), Absolute=False)

# ----
# Collision meshes
preview = CustomPreview(
    Geometry=aoadisp.ColoredCollisionMeshes,
    Material={diffuse=RGB(221, 160, 221), emission=RGB(66, 48, 66), shine=0.5, specular=RGB(255, 255, 255), transparency=0})  # disabled

# ----
# identify type 1 Horizontal-Vertical
data_2 = Data(aoadecon.AssemblageObjects)

dam = DataDam(DataA=data_2, BufferDelay=10000000, BufferMode=0)

# ---- group: identify type
aoetype = ExtractType(AssemblyObject=dam)
equals = Equality(FirstNumber=aoetype, SecondNumber="0")  # -> Equality, Inequality

# ----
associate_xdata_2 = AssociateXData(AssemblyObjects=data_2, XData=merge_10)  # "AO<>XD"

# ---- group: identify type
aoetype_2 = ExtractType(AssemblyObject=data_2)
equals_2 = Equality(FirstNumber=aoetype_2, SecondNumber="1")  # -> Equality, Inequality

# ----
# 1st selection filter
cull_2 = CullPattern(List=dam, CullPattern=equals.Equality)

# ---- group: separate types
dispatch = Dispatch(List=data_2, DispatchPattern=equals_2.Equality)  # -> ListA, ListB

# ---- group: identify horizontal alignment
aoerplane_2 = ExtractReferencePlane(AssemblyObject=cull_2)
deplane = DeconstructPlane(Plane=aoerplane_2)  # -> Origin, XAxis, YAxis, ZAxis
Z_2 = UnitZ(Factor=1)
dprod = DotProduct(VectorA=deplane.ZAxis, VectorB=Z_2, Unitize=False)
similar = Similarity(FirstNumber=dprod, SecondNumber="1", Threshold=0.1)  # -> Similarity, AbsoluteDifference

# ---- group: identify horizontal-vertical alignment
aoerplane_3 = ExtractReferencePlane(AssemblyObject=dispatch.ListA)
deplane_2 = DeconstructPlane(Plane=aoerplane_3)  # -> Origin, XAxis, YAxis, ZAxis
Z_3 = UnitZ(Factor=1)
dprod_2 = DotProduct(VectorA=deplane_2.XAxis, VectorB=Z_3, Unitize=False)
abs = Absolute(Value=dprod_2)

# ----
lng = ListLength(List=dispatch.ListB)
repeat = RepeatData(Data="0", Length=lng)

# ----
# 2nd selection filter
cull_3 = CullPattern(List=cull_2, CullPattern=similar.Similarity)

# ---- group: regroup types
weave_2 = Weave(Pattern=equals_2.Equality, Stream0=repeat, Stream1=abs, NullGaps=False)

# ----
item_4 = ListItem(List=associate_xdata, Index=weave_2, Wrap=True)
item_5 = ListItem(List=associate_xdata_2, Index=weave_2, Wrap=True)
xddecon_2 = DeconstructXData(XData=item_4)  # -> Label, AssemblyObjectNameReference, ReferencePlane, Data

# ----
# controlla se le clash lines si scontrano con la geometria effettiva
aoerplane_4 = ExtractReferencePlane(AssemblyObject=cull_3)
mesh_18 = Mesh(xddecon_2.Data)
mjoin = MeshJoin(Meshes=flatten(mesh_18))
orient = Orient(Geometry=line, Source=pln, Target=aoerplane_4)  # -> Geometry, Transform
mcx = MeshCurve(Mesh=mjoin, Curve=orient.Geometry)  # -> Points, Faces

# ----
# Utilizzate questo componente per fare il bake su Rhino
mesh_19 = Mesh(xddecon_2.Data)

pshift = ShiftPaths(Data=mcx.Points, Offset=-1)

f_mmeea = MeshesExtractEdgesWithToleranceAngle(Mesh=mesh_19, Angle=45)  # -> InternalEdges, NakedEdges
previewlw_3 = CustomPreviewLineweights(Geometry=f_mmeea.InternalEdges, Shader=ColourSwatch(SwatchColor=RGB(0, 0, 0)), Absolute=False)

lng_2 = ListLength(List=pshift)

# ----
# Actual geometries
preview_2 = CustomPreview(Geometry=mesh_19, Material=graft(aoadisp.Colors))

equals_3 = Equality(FirstNumber=lng_2, SecondNumber="0")  # -> Equality, Inequality
cull_4 = CullPattern(List=cull_3, CullPattern=equals_3.Equality)

# ----
# Circulation path
associate_xdata_3 = AssociateXData(AssemblyObjects=cull_4, XData=xdcon_6)  # "AO<>XD"
xddecon_3 = DeconstructXData(XData=item_5)  # -> Label, AssemblyObjectNameReference, ReferencePlane, Data
xddecon_4 = DeconstructXData(XData=associate_xdata_3)  # -> Label, AssemblyObjectNameReference, ReferencePlane, Data
merge_17 = Merge(Data1=xddecon_3.Data, Data2=xddecon_4.Data)
pshift_2 = ShiftPaths(Data=merge_17, Offset="-2")

aoerplane_5 = ExtractReferencePlane(AssemblyObject=cull_4)
orient_2 = Orient(Geometry=mesh_16, Source=pln, Target=flatten(aoerplane_5))  # -> Geometry, Transform

# ----
# Utilizzate questo componente per fare il bake su Rhino
mesh_20 = Mesh(orient_2.Geometry)

# ----
# Stair
mjoin_2 = MeshJoin(Meshes=flatten(mesh_20))
f_mseea = MeshExtractEdgesWithToleranceAngle(Mesh=mjoin_2, Angle=45)  # -> InternalEdges, NakedEdges
preview_3 = CustomPreview(Geometry=mjoin_2, Material=graft(ColourSwatch(SwatchColor=RGB(0, 229, 255))))
previewlw_4 = CustomPreviewLineweights(Geometry=[f_mseea.InternalEdges, f_mseea.NakedEdges], Shader=ColourSwatch(SwatchColor=RGB(0, 0, 0)), Absolute=False)

# ----
# da utilizzare per circulation analysis
previewlw_5 = CustomPreviewLineweights(Geometry=pshift_2, Shader=ColourSwatch(SwatchColor=RGB(0, 17, 255)), Thickness="2", Absolute=False)

crv_17 = Curve(pshift_2)
