# Grasshopper definition Animation path example.gh (Grasshopper 1.0.7)
# plug-ins: froGH

# ---- group: curva di percorso da Rhino (polilinea)
crv = Curve(<curve referenced from the Rhino model>)

# ----
# 2
# animare questo slider
# 
# right click > Animate
# oppure fare una live preview attivando go e regolando la velocità (speed)
position_along_curve = Slider(0, range=0..1)

list = ValueList({"manuale/record": 0, "live animation": 1}, selected="live animation")
fillet = Fillet(Curve=crv, Radius=Slider(1.696, range=0..5))
# <title>
# 
# <description>
# 
# code by Alessio Erioli
# 
# v 0.1
# © a3 2021 / Creative Commons Attribution-Non Commercial-ShareAlike 4.0 International License
crv_2 = Curve(reparameterize(fillet))
eye_anticipation = Slider(0.071, range=0..0.1)
list_2 = ValueList({"fixed point": 0, "along trajectory": 1}, selected="along trajectory")
pt = Point(Point(-42.84454371, 99.49514485, 62.54867461))

# ----
# attivare il controllo della telecamera
# 1
activate = BooleanToggle(True)

# ---- group: live animation
reset = Button()
go = BooleanToggle(False)
speed = Slider(500, range=0..10000)

# ---- group: live animation / a simple counter
counter = CSharpScript(reset=reset, go=go, max=speed)  # -> C; inputs reset: Boolean, go: Boolean, max: Int32
# ---------- counter: C# ----------
    if(reset) count = 0;
    if (go && count < max)
    {
      count++;
      Component.ExpireSolution(true);
    }
    C = count;
# ---------- counter: C# additional code ----------
  int count;
# ---------- end counter ----------

# ---- group: live animation (continued)
division = Division(A=counter, B=speed)

# ----
filter = StreamFilter(Gate=list, Stream0=position_along_curve, Stream1=division)
panel = Panel(filter)
addition = Addition(A=filter, B=eye_anticipation)
eval = EvaluateCurve(Curve=crv_2, Parameter=addition)  # -> Point, Tangent, Angle
eval_2 = EvaluateCurve(Curve=crv_2, Parameter=filter)  # -> Point, Tangent, Angle
filter_2 = StreamFilter(Gate=list_2, Stream0=pt, Stream1=eval.Point)
f_camcon = CameraControl(Location=eval_2.Point, Target=filter_2, Lens=Slider(21, range=21..120), UpVector=Vector(0, 0, 1), Activate=activate)
