# Grasshopper definition Scatterplot.gh (Grasshopper 1.0.7)
# Copyright: Co-de-iT
# plug-ins: froGH, Human

# try the Remote Control Panel: View > Remote Control Panel
f_ghfilepath = GHFilePathInfo()  # -> FileName, FilePath
f_dirread = DirectoryReader(DirectoryPath=f_ghfilepath.FilePath)  # -> FileList, SubdirList
tmatch = MatchText(Text=f_dirread.FileList, Pattern="*.csv", Case=True)
cull = CullPattern(List=f_dirread.FileList, CullPattern=tmatch)
panel = Panel(cull)
item = ListItem(List=cull, Index=Slider(2, range=0..2), Wrap=True)
# <title>
# 
# <description>
# 
# code by Alessio Erioli
# 
# v 0.1
# © a3 2021 / Creative Commons Attribution-Non Commercial-ShareAlike 4.0 International License
concat = Concatenate(FragmentA=f_ghfilepath.FilePath, FragmentB=item)
panel_2 = Panel(item)
file = ReadFile(File=concat, PerLineParse=True)
diagram_size = Slider(50, range=1..50)
id_text_size = Slider(0.592, range=0..2)
id_text_offset = Slider(1, range=0..1)
text_size = Slider(0.617, range=0..2)
x_feature = Slider(0, range=0..1)
y_feature = Slider(1, range=0..1)
point_size = Slider(0.402, range=0..1)
pt = Point(Point(0, 0, 0))
split = TextSplit(Text=file, Separators=",")
flip = FlipMatrix(Data=split)
split_2 = SplitList(List=flip, Index="1")  # -> flatten(ListA), ListB
pshift = ShiftPaths(Data=split_2.ListB, Offset=-1)

# ---- group: diagram lines
X = UnitX(Factor=1)
Y = UnitY(Factor=1)
line = LineSDL(Start=pt, Direction=[X, Y], Length=diagram_size)

# ----
split_3 = SplitTree(Data=pshift, Masks=flatten("{*;0}"))  # -> Positive, Negative
split_4 = SplitList(List=split_2.ListA, Index="1")  # -> ListA, ListB

# ---- group: diagram label points
addition = Addition(A=X, B=Y)
multiplication = Multiplication(A=addition, B="-0.5")
move = Move(Geometry=pt, Motion=multiplication)  # -> Geometry, Transform
panel_3 = Panel("""0
90""")
prot = RotatePlane(Plane=move.Geometry, Angle=degrees(panel_3))
X_2 = UnitX(Factor=1)
Y_2 = UnitY(Factor=1)
merge = Merge(Data1=X_2, Data2=Y_2)
move_2 = Move(Geometry=prot, Motion=merge)  # -> Geometry, Transform

# ----
data = Data(split_3.Negative)
tstat = TreeStatistics(Tree=split_3.Negative)  # -> Paths, Length, expr("x-1", Count)

# ---- group: data remapping
bnd = Bounds(Numbers=data)
number_slider = Slider(0.539, range=0..1)
dedomain = DeconstructDomain(Domain=bnd)  # -> Start, End
subtraction = Subtraction(A=dedomain.Start, B=number_slider)  # -> flatten(Result)
addition_2 = Addition(A=dedomain.End, B=number_slider)  # -> flatten(Result)
multiplication_2 = Multiplication(A=diagram_size, B=Slider(0.95, range=0..1))
dom = ConstructDomain(DomainStart="0.1", DomainEnd=multiplication_2)
dom_2 = ConstructDomain(DomainStart=flatten(subtraction), DomainEnd=addition_2)
remap = RemapNumbers(Value=data, Source=graft(dom_2), Target=dom)  # -> Mapped, Clipped

# ----
multiplication_3 = Multiplication(A=tstat.Count, B=x_feature)
multiplication_4 = Multiplication(A=tstat.Count, B=y_feature)
viewer = ParamViewer(remap.Mapped)
item_2 = ListItem(List=viewer, Index=multiplication_3, Wrap=True)
item_3 = ListItem(List=viewer, Index=multiplication_4, Wrap=True)
item_4 = ListItem(List=split_4.ListB, Index=multiplication_3, Wrap=True)
panel_4 = Panel(item_4)
item_5 = ListItem(List=split_4.ListB, Index=multiplication_4, Wrap=True)
panel_5 = Panel(item_5)
Y_3 = UnitY(Factor=1)
branch = TreeBranch(Tree=remap.Mapped, Path=item_2, MaintainPaths=True)
branch_2 = TreeBranch(Tree=remap.Mapped, Path=item_3, MaintainPaths=True)
swatch = ColourSwatch(SwatchColor=RGB(0, 0, 0))
multiplication_5 = Multiplication(A=Y_3, B=id_text_offset)
panel_6 = Panel("""1
7""")
pt_2 = ConstructPoint(XCoordinate=branch, YCoordinate=branch_2, ZCoordinate=0)
move_3 = Move(Geometry=pt_2, Motion=multiplication_5)  # -> Geometry, Transform
previewlw = CustomPreviewLineweights(Geometry=line, Shader=swatch, Absolute=False)
tag = TextTag3D(Location=move_2.Geometry, Text=[item_4, item_5], Size=text_size, Colour=swatch, Justification=panel_6)
lng = ListLength(List=pt_2)
wheel = ColourWheel(
    lng,
    ColourGrips_Style=30,
    ColourGrips_Grip=[0.636689826, 2.094395102, 4.188790205, 3.141592654],
    ColourGrips_Lum=[0.3837606541, 0.6554848017],
    ColourGrips_Range=[0.515881101, 0.515881101, 0.515881101, 0.515881101],
    ColourGrips_Sat=[0.1035496897, 0.9126757199])
tag_2 = TextTag3D(Location=move_3.Geometry, Text=split_3.Positive, Size=id_text_size, Colour=wheel, Justification=8)
dots = DotDisplay(Point=pt_2, Colour=wheel, Size=point_size)
