# Grasshopper definition save data to csv.gh (Grasshopper 1.0.7)
# Copyright: Co-de-iT
# plug-ins: froGH

# <title>
# 
# <description>
# 
# code by Alessio Erioli
# 
# v 0.1
# © a3 2021 / Creative Commons Attribution-Non Commercial-ShareAlike 4.0 International License
# Potete creare i vostri file dati direttamente in Excel, usando uno dei file .csv forniti come esempio per la formattazione in righe/colonne
f_ghfilepath = GHFilePathInfo()  # -> FileName, FilePath

# ---- group: Save data to .csv file / labeled data
data = Data(Tree({0;0;0}: ["Test ID", "Area", "Volume", "Impronta", "Direzionalità", "Estensione", "Floor factor"], {0;0;1}: ["a", "4.055608", "1.555018", "11.629065", "13.236573", "3.196002", "8.130249"], {0;0;2}: ["b", "1.064472", "8.595034", "6.501537", "12.795067", "3.725349", "9.590332"], {0;0;3}: ["c", "8.006945", "6.018649", "10.18089", "9.904479", "2.457585", "5.875481"], {0;0;4}: ["d", "8.282333", "12.011501", "7.619557", "12.521952", "3.539057", "7.938159"], {0;0;5}: ["e", "13.49223", "11.092915", "2.155688", "3.825754", "2.387194", "9.959959"]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))

# ----
panel = Panel(data)

# ---- group: Save data to .csv file
file_name = Panel("spider graph data.csv")
save = Button()

join = TextJoin(Text=data, Join=",")  # -> flatten(Result)
f_str2file = SaveStringToFile(String=join, FilePath=f_ghfilepath.FilePath, FileName=file_name, SaveTrigger=save)

# ----
panel_2 = Panel(join)
