# Grasshopper definition Autoplan.gh (Grasshopper 1.0.7)
# Copyright: Co-de-iT
# plug-ins: froGH, Human

# This subdir must already exist
subdir = Panel("plans")

# ---- group: small assemblage (171 meshes)
# reference the meshes in the assemblage (or the part you want to analyze) here
mesh = Mesh([<mesh referenced from the Rhino model> x176])

# ---- group: intermediate assemblage (509 meshes)
mesh_2 = Mesh([<mesh referenced from the Rhino model> x592])

# ---- group: entire assemblage (2001 meshes)
# keep it > 0 to avoid false positives
# intercept distance should be related to the height necessary for a person to walk through a space
mesh_3 = Mesh([<mesh referenced from the Rhino model> x2001])

# ----
interplane_distance = Slider(-10, range=-10..-3)
# Set these to move the clipping plane out of the View
planes_x_position = Slider(0, range=-100..100)
planes_y_position = Slider(0, range=-100..100)

scale_length = Slider(10, range=1..50)
text_size = Slider(2, range=1..5)
text_color = ColourSwatch(SwatchColor=RGB(0, 0, 0))

list = ValueList({"Manual browse": 0, "Animation": 1}, selected="Animation")
browse_floors = Slider(1, range=0..1)
animate = BooleanToggle(False)
view_name_to_save_animation_from = Panel("Top")
panel = Panel("delay in milliseconds")

id = Guid([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])
f_ghfilepath = GHFilePathInfo()  # -> FileName, FilePath
# . make 2 Clipping Planes in Rhino
# 
# . ensure they are active in the View you want to export
# 
# . import them here (right-click > Set Multiple Guids)
# 
# Any clipping plane will do, the orientation will be decided here in the definition.
grouping_distance_m = Slider(1.5, range=0.1..10)
length_threshold = Slider(1.2, range=0..2)
area_threshold = Slider(4, range=0..50)
concat = Concatenate(FragmentA=f_ghfilepath.FilePath, FragmentB=subdir)

# ---- group: input meshes here
# Assembler
# 
# Framework for Iterative Assemblages workflow
# 
# code by Alessio Erioli
# 
# v 1.0
# © Co-de-iT 2021 / Creative Commons Attribution-Non Commercial-ShareAlike 4.0 International License
mesh_4 = Mesh(mesh_3)

# ----
start_point_offset = Panel("0.01")
angle_tolerance = Panel("0.01")

intercept_distance = Panel("2")
mjoin = MeshJoin(Meshes=mesh_4)
bbox = BoundingBox(Content=mjoin, Plane=PlaneXY(0, 0, 0), UnionBox=True)  # -> Box, Box_2
box = EvaluateBox(Box=bbox.Box, UParameter="0", VParameter="0", WParameter=0.5)  # -> Plane, Point, Include
box_2 = EvaluateBox(Box=bbox.Box, UParameter="1", VParameter="0", WParameter=0.5)  # -> Plane, Point, Include
item = ListItem(List=id, Index=0, Wrap=True)  # -> Item, Item1
pdecon = Deconstruct(Point=box_2.Point)  # -> XComponent, YComponent, ZComponent
X = UnitX(Factor="-1")
panel_2 = Panel("""0
1""")
pdecon_2 = Deconstruct(Point=box.Point)  # -> XComponent, YComponent, ZComponent
Z = UnitZ(Factor=interplane_distance)
Y = UnitY(Factor="-1")
merge = Merge(Data1="0 m", Data2=scale_length)

# ----
# Filtering
# filter meshes below a certain area threshold (cull small pieces)
# remove faces with small edges (most probably walls, slab thicknesses or pillars)
# remove faces with normals NOT pointing in the direction of the global Z
# (with a tolerance)
# exclude faces with obstacles along the normal
# weld meshes and disjoint separate chunks
# sorry, I'd rather not do clusters but this definition is already messy enough as it is!
remove_non_horizontal_faces = RemoveNonHorizontalFaces(mesh=mjoin, angle_tolerance=angle_tolerance)
remove_occluded_faces = RemoveOccludedFaces(mesh=remove_non_horizontal_faces, num_2=start_point_offset, num=intercept_distance)

# ----
# this might be the second bottleneck
remove_thicknesses_approx = RemoveThicknessesApprox(mesh=remove_occluded_faces, num=length_threshold)

# ----
# this might be a bottleneck
weld_and_separate_chunks = WeldAndSeparateChunks(mesh=remove_thicknesses_approx)

filter_small_pieces = FilterSmallPieces(mesh=weld_and_separate_chunks, num=area_threshold)

# ----
# sort meshes by Z (for clarity)
mesh_5 = Mesh(filter_small_pieces)
area = Area(Geometry=mesh_5)  # -> Area, Centroid
pdecon_3 = Deconstruct(Point=area.Centroid)  # -> XComponent, YComponent, ZComponent
sort = SortList(Keys=pdecon_3.ZComponent, ValuesA=mesh_5)  # -> Keys, ValuesA

# ----
# group meshes by floor height (approximated to the grouping distance)
# sorry, I'd rather not do clusters but this definition is already messy enough as it is!
group_by_distance = GroupByDistance(mesh=sort.ValuesA, num=grouping_distance_m)

bbox_2 = BoundingBox(Content=group_by_distance, Plane=PlaneXY(0, 0, 0))  # -> Box, Box_2
box_3 = EvaluateBox(Box=bbox_2.Box, UParameter=0.5, VParameter=0.5, WParameter=0.5)  # -> Plane, Point, Include
deplane = DeconstructPlane(Plane=box_3.Plane)  # -> Origin, XAxis, YAxis, ZAxis
multiplication = Multiplication(A=deplane.ZAxis, B="1.5")
move = Move(Geometry=box_3.Plane, Motion=multiplication)  # -> Geometry, Transform
lng = ListLength(List=move.Geometry)  # -> expr("x-1", Length)
lng_2 = ListLength(List=move.Geometry)
c_script = CSharpScript(go=animate, delay=Slider(100, range=10..1000), tot=lng_2)  # -> out, C; inputs go: Boolean, delay: Int32, tot: Int32
# ---------- c_script: C# ----------
    if (!go)
    {
      count = 0;
      first = true;
    }
    else
    {
      if (count < tot - 1)
      {
        if (count == 0 && first)
        {
          Component.ExpireSolution(true);
          first = false;
        }
        else
        {
          count++;
          System.Threading.Thread.Sleep(delay);
          Component.ExpireSolution(true);
        }
      }
    }

    C = count;
# ---------- c_script: C# additional code ----------
  int count;
  bool first;
# ---------- end c_script ----------
equals = Equality(FirstNumber=expr("x-1", lng_2), SecondNumber=c_script.C)  # -> Equality, Inequality
f_tas = ToggleAutostop(Toggle=animate, Condition=equals.Equality)
multiplication_2 = Multiplication(A=browse_floors, B=lng)
filter = StreamFilter(Gate=list, Stream0=multiplication_2, Stream1=c_script.C)
int = Integer(filter)
item_2 = ListItem(List=move.Geometry, Index=int, Wrap=True)
pdecon_4 = Deconstruct(Point=item_2)  # -> XComponent, YComponent, ZComponent
pt = ConstructPoint(XCoordinate=pdecon.XComponent, YCoordinate=pdecon.YComponent, ZCoordinate=pdecon_4.ZComponent)
pl_origin = PlaneOrigin(Base=box_2.Plane, Origin=pt)
expression = Expression(x=pdecon_4.ZComponent, y=int, z=lng_2, Expression="Format(\"plan h {0:0.00}m - {1}/{2}\", x, y+1, z)")

rep = ReplaceText(Text=expression, Find=".", Replace="_", RecursiveReplace=False)
rep_2 = ReplaceText(Text=rep, Find="/", Replace="-", RecursiveReplace=False)

concat_2 = Concatenate(FragmentA=rep_2, FragmentB=".png")
f_vc2f = ViewCaptureToFile(
    FilePath=concat,
    FileName=concat_2,
    ViewportName=view_name_to_save_animation_from,
    Scale=1,
    Grid=False,
    Axes=False,
    Widget=False,
    Capture=animate)
line = LineSDL(Start=pl_origin, Direction=X, Length=scale_length)
pt_2 = ConstructPoint(XCoordinate=planes_x_position, YCoordinate=planes_y_position, ZCoordinate=pdecon_4.ZComponent)
eval = EvaluateCurve(Curve=reparameterize(line), Parameter=panel_2)  # -> Point, Tangent, Angle
pl_origin_2 = PlaneOrigin(Base=item_2, Origin=pt_2)
pt_3 = ConstructPoint(XCoordinate=pdecon_2.XComponent, YCoordinate=pdecon_2.YComponent, ZCoordinate=pdecon_4.ZComponent)
move_2 = Move(Geometry=eval.Point, Motion=Y)  # -> reverse(Geometry), Transform
pflip = FlipPlane(Plane=pl_origin_2, ReverseX=False, ReverseY=False, SwapAxes=True)
move_3 = Move(Geometry=pl_origin_2, Motion=Z)  # -> Geometry, Transform
pl_origin_3 = PlaneOrigin(Base=box.Plane, Origin=pt_3)
previewlw = CustomPreviewLineweights(Geometry=line, Shader=text_color, Absolute=False)

# ---- group: clipping plane control
c_script_2 = CSharpScript(id=item.Item, P=pflip)  # inputs id: Guid, P: Plane
# ---------- c_script_2: C# usings ----------
using System.IO;
using System.Linq;
using System.Data;
using System.Drawing;
using System.Reflection;
using System.Windows.Forms;
using System.Xml;
using System.Xml.Linq;
using System.Runtime.InteropServices;

using Rhino.DocObjects;
using Rhino.Collections;
using GH_IO;
using GH_IO.Serialization;
# ---------- c_script_2: C# ----------
    if (id == null) return;
    Rhino.DocObjects.ObjRef obj;
    if (Rhino.RhinoApp.ExeServiceRelease < 5)
      obj = new Rhino.DocObjects.ObjRef(id);
    else obj = new Rhino.DocObjects.ObjRef(doc, id);
    Rhino.DocObjects.ClippingPlaneObject cpObj = obj.Object() as Rhino.DocObjects.ClippingPlaneObject;
    cpObj.ClippingPlaneGeometry.Plane = P;
    cpObj.CommitChanges();
# ---------- end c_script_2 ----------
c_script_3 = CSharpScript(id=item.Item1, P=move_3.Geometry)  # inputs id: Guid, P: Plane; same code as c_script_2

# ----
tag = TextTag3D(Location=move_2.Geometry, Text=merge, Size=text_size, Colour=text_color, Justification=2)
tag_2 = TextTag3D(Location=pl_origin_3, Text=expression, Size=text_size, Colour=text_color, Justification=1)

# ==== cluster RemoveOccludedFaces
mesh = ClusterInput()
num = ClusterInput()
num_2 = ClusterInput()
num_3 = Number(num)
num_4 = Number(num_2)

# ----
# intercept distance should be related to the height necessary for a person to walk through a space
mesh_2 = Mesh(mesh)
facen = FaceNormals(Mesh=mesh_2)  # -> Centers, Normals
# exclude faces with obstacles along the normal
Z = UnitZ(Factor=num_4)
move = Move(Geometry=facen.Centers, Motion=Z)  # -> Geometry, Transform
line = LineSDL(Start=move.Geometry, Direction=facen.Normals, Length=num_3)
mcx = MeshCurve(Mesh=mesh_2, Curve=line)  # -> Points, flatten(Faces)
lng = ListLength(List=mcx.Points)
equals = Equality(FirstNumber=lng, SecondNumber="0")  # -> flatten(Equality), flatten(Inequality)
cullf = CullFaces(Mesh=mesh_2, Pattern=equals.Inequality)

mesh_3 = Mesh(cullf)
mesh_4 = ClusterOutput(mesh_3)

# ==== cluster RemoveThicknessesApprox
mesh = ClusterInput()
num = ClusterInput()
num_2 = Number(num)

mesh_2 = Mesh(mesh)

f_mc_fpm = MeshConnectivityFaceProximityMap(Mesh=mesh_2)  # -> ConnectedVertices, ConnectedEdges, ConnectedFaces
f_medges = ExtractMeshEdges(Mesh=mesh_2)  # -> Edges, WeldStatus, EdgeStatus
item = ListItem(List=f_medges.Edges, Index=f_mc_fpm.ConnectedEdges, Wrap=True)
item_2 = ListItem(List=f_medges.EdgeStatus, Index=f_mc_fpm.ConnectedEdges, Wrap=True)

# ----
# remove faces with small edges (most probably walls, slab thicknesses or pillars)
len = Length(Curve=item)
sort = SortList(Keys=len, ValuesA=item_2)  # -> Keys, ValuesA
item_3 = ListItem(List=sort.Keys, Index=0, Wrap=True)
pshift = ShiftPaths(Data=item_3, Offset=-1)
smaller = SmallerThan(FirstNumber=pshift, SecondNumber=num_2)  # -> SmallerThan, OrEqualTo

# ---- group: is one of the longest 2 edges naked?
panel = Panel("""-1
-2""")
item_4 = ListItem(List=sort.ValuesA, Index=panel, Wrap=True)
f_massbool = MassBoolean(Values=item_4, BooleanOperator="OR", Boolean_Operator="OR")
pshift_2 = ShiftPaths(Data=f_massbool, Offset=-1)
equals = Equality(FirstNumber=pshift_2, SecondNumber="0")  # -> Equality, Inequality

# ----
and = GateAnd(A=smaller.SmallerThan, B=equals.Equality)
cullf = CullFaces(Mesh=mesh_2, Pattern=and)

mesh_3 = Mesh(cullf)
mesh_4 = ClusterOutput(mesh_3)

# ==== cluster WeldAndSeparateChunks
mesh = ClusterInput()

mesh_2 = Mesh(mesh)
panel = Panel("fix normals")

# ----
# weld them and disjoint separate chunks
# this component is the bottleneck
alignvert = AlignVertices(Mesh=mesh_2, Tolerance=0.01)  # -> Result, Count

weld = WeldMesh(Mesh=alignvert.Result, Angle=3.141592654)
disjoint = DisjointMesh(Mesh=weld)

unim = UnifyMesh(Mesh=disjoint)  # -> Result, Count

mesh_3 = Mesh(unim.Result)
mesh_4 = ClusterOutput(mesh_3)

# ==== cluster FilterSmallPieces
mesh = ClusterInput()
num = ClusterInput()
num_2 = Number(num)

mesh_2 = Mesh(mesh)
# filter meshes below a certain area threshold (cull small pieces)
area = Area(Geometry=mesh_2)  # -> Area, Centroid
larger = LargerThan(FirstNumber=area.Area, SecondNumber=num_2)  # -> LargerThan, OrEqualTo
cull = CullPattern(List=mesh_2, CullPattern=larger.LargerThan)

mesh_3 = Mesh(cull)
mesh_4 = ClusterOutput(mesh_3)

# ==== cluster GroupByDistance
mesh = ClusterInput()
num = ClusterInput()
num_2 = Number(num)

mesh_2 = Mesh(mesh)
area = Area(Geometry=mesh_2)  # -> Area, Centroid
pdecon = Deconstruct(Point=area.Centroid)  # -> XComponent, YComponent, ZComponent

# ---- group: OLD method / "normalize" heights (start from 0)
bnd = Bounds(Numbers=pdecon.ZComponent)  # disabled
dedomain = DeconstructDomain(Domain=bnd)  # -> Start, End; disabled
subtraction = Subtraction(A=pdecon.ZComponent, B=dedomain.Start)  # disabled

# ----
f_ifroml = IndexesFromList(Data=pdecon.ZComponent)
# group meshes by floor height (approximated to the grouping distance)
pt = ConstructPoint(XCoordinate=0, YCoordinate=0, ZCoordinate=pdecon.ZComponent)
sort = SortList(Keys=pdecon.ZComponent, ValuesA=f_ifroml)  # -> Keys, ValuesA
item = ListItem(List=sort.ValuesA, Index=0, Wrap=True)
f_ptscbd = ClusterizePointsByDistance(Points=pt, Index=item, ClusterizationDistance=num_2)  # -> ClusteredPoints, ClusteredIndices

# ---- group: OLD method
division = Division(A=subtraction, B=num_2)  # disabled
round = Round(Number=division)  # -> Nearest, Floor, Ceiling; disabled
cset = CreateSet(List=round.Nearest)  # -> Set, Map; disabled
f_ifroml_2 = IndexesFromList(Data=cset.Set)  # disabled
mindex = MemberIndex(Set=cset.Map, Member=f_ifroml_2)  # -> Index, Count; disabled

# ----
item_2 = ListItem(List=mesh_2, Index=f_ptscbd.ClusteredIndices, Wrap=True)
mjoin = MeshJoin(Meshes=item_2)  # -> flatten(Mesh)

mesh_3 = Mesh(mjoin)
mesh_4 = ClusterOutput(mesh_3)

# ==== cluster RemoveNonHorizontalFaces
mesh = ClusterInput()
angle_tolerance = ClusterInput()

mesh_2 = Mesh(mesh)
# remove faces with normals NOT pointing in the direction of the global Z
# (with a tolerance)
facen = FaceNormals(Mesh=mesh_2)  # -> Centers, Normals
Z = UnitZ(Factor=1)
angle = Angle(VectorA=facen.Normals, VectorB=Z)  # -> Angle, Reflex

smaller = SmallerThan(FirstNumber=angle.Angle, SecondNumber=angle_tolerance)  # -> SmallerThan, OrEqualTo

not = GateNot(A=smaller.SmallerThan)
cullf = CullFaces(Mesh=mesh_2, Pattern=not)

mesh_3 = Mesh(cullf)
mesh_4 = ClusterOutput(mesh_3)
