# Grasshopper definition 06_trees.gh (Grasshopper 1.0.7)
# Copyright: Co-de-iT

# <title>
# 
# <description>
# 
# code by Alessio Erioli
# 
# v 0.1
# DataTrees (reprise)
# Anche se l'aspetto dei cavi è diverso per dato singolo, lista e DataTree, in realtà in Grasshopper TUTTO è organizzato in DataTrees: dati singoli e liste sono casi particolari di Data Tree.
panel = Panel("topics avanzati (opzionali)")

# ----
# single datum
# Un dato singolo è il caso più semplice di Data Tree: un solo ramo, contenente un solo dato
# DataTree - intuitive explanation
# Check Andrew Heumann's guide to Data Trees
# 
# https://cpb-us-e1.wpmucdn.com/blogs.uoregon.edu/dist/0/8936/files/2014/11/Data-Trees-2h4tzjd.pdf
num = Number(42)
# single item
# item index
panel_2 = Panel(num)
# © a3 2021 / Creative Commons Attribution-Non Commercial-ShareAlike 4.0 International License
# branch index
viewer = ParamViewer(panel_2)
# {0}
# {0;0}
viewer_2 = ParamViewer(panel_2)

# ----
# {0;0;0}
# {0;0;1}
# (0)
#  (1)
#   .
#   .
#   .
# (n-1)
data = Data(Tree({0;0;0}: [Point(0.5, 0.5, 0), Point(0.5, 1.5, 0), Point(0.5, 2.5, 0), Point(0.5, 3.5, 0)], {0;0;1}: [Point(1.5, 0.5, 0), Point(1.5, 1.5, 0), Point(1.5, 2.5, 0), Point(1.5, 3.5, 0)], {0;0;2}: [Point(2.5, 0.5, 0), Point(2.5, 1.5, 0), Point(2.5, 2.5, 0), Point(2.5, 3.5, 0)]))

# ----
# list
# Una lista è un DataTree con un solo ramo e n dati, indicizzati da 0 a n-1. Un dato singolo può anche essere considerato un caso particolare di lista (per n=1)
num_2 = Number([0, 1, 2, 3, 4, 5, 6, 7, 8, 9])
# branch index
# item index
# list
panel_3 = Panel(num_2)
viewer_3 = ParamViewer(panel_3)
viewer_4 = ParamViewer(panel_3)

# ----
# {0;1}
# {0;1;0} . . . {0;1;3}
# {0;2;0}
# {0;2;1}
# (2)
# structure
viewer_5 = ParamViewer(data)
# data tree
viewer_6 = ParamViewer(data)

# ----
# tree
# Il DataTree è una "lista di liste", nel caso più generale comprende m rami, ognuno dei quali contiene una lista.
# Gli elementi di una lista vengono processati insieme; ogni ramo viene processato in modo indipendente.
# branch index: Il suo formato è {A;B;C;...}
# 
# Da sinistra a destra si passa dal livello più generale a quello più specifico ed annidato
# item index: va da 0 a n-1 (n= numero di elementi nella lista)
# tree
# i rami rossi con punti arancioni rappresentano le liste del DataTree (dove sono effettivamente i dati)
num_3 = Number(Tree({0;0;0}: [0, 1, 2], {0;0;1}: [1, 2, 3], {0;0;2}: [2, 3, 4], {0;0;3}: [3, 4, 5]))
panel_4 = Panel(num_3)
viewer_7 = ParamViewer(panel_4)
# campus 0
# campus
# building 2
viewer_8 = ParamViewer(panel_4)

# ----
# {0;2}
# space 2
# building
# floor 2
# space 1
# floor 1
# space 0
# floor 0
# floor
# floor 1
# {0;2;2}
# floor 0
# building 0
# {0;2;0}(2)
# space
# content
# branch {0;0;0}
# branch {0;0;1}
# branch {0;0;2}
# item {0;0;2} (2)
panel_5 = Panel(data)
# Flatten
txt = Text(Tree({0;0;0}: ["A"], {0;0;1}: ["B"], {0;0;2}: ["C"], {0;1;0}: ["D"], {0;1;1}: ["E"], {0;1;2}: ["F"]))
# building 1
# Shift Paths/Trim Tree
# floor 3
# floor 2
# floor 1
# floor 0
txt_2 = Text(Tree({0;0;0}: ["A"], {0;0;1}: ["B"], {0;0;2}: ["C"], {0;1;0}: ["D"], {0;1;1}: ["E"], {0;1;2}: ["F"]))
data_2 = Data(Tree({0;0}: ["A", "B", "C", "D"], {0;1}: ["E", "F", "G", "H"], {0;2}: ["I", "J", "K", "L"]))
# Graft
txt_3 = Text(Tree({0;0}: ["A", "B", "C"], {0;1}: ["D", "E", "F"]))
data_3 = Data(Tree({0;0;0}: [Point(0.5, 0.5, 0), Point(0.5, 1.5, 0), Point(0.5, 2.5, 0), Point(0.5, 3.5, 0)], {0;0;1}: [Point(1.5, 0.5, 0), Point(1.5, 1.5, 0), Point(1.5, 2.5, 0), Point(1.5, 3.5, 0)], {0;0;2}: [Point(2.5, 0.5, 0), Point(2.5, 1.5, 0), Point(2.5, 2.5, 0), Point(2.5, 3.5, 0)]))
viewer_9 = ParamViewer(txt)
viewer_10 = ParamViewer(txt)
panel_6 = Panel(txt)
viewer_11 = ParamViewer(txt_2)
# illustration by Andrew Heumann
viewer_12 = ParamViewer(txt_2)
panel_7 = Panel(txt_2)
# Tree Statistics
data_4 = Data(Tree({0;0;0}: [Point(0.5, 0.5, 0), Point(0.5, 1.5, 0), Point(0.5, 2.5, 0), Point(0.5, 3.5, 0)], {0;0;1}: [Point(1.5, 0.5, 0), Point(1.5, 1.5, 0), Point(1.5, 2.5, 0), Point(1.5, 3.5, 0)], {0;0;2}: [Point(2.5, 0.5, 0), Point(2.5, 1.5, 0), Point(2.5, 2.5, 0), Point(2.5, 3.5, 0)]))
viewer_13 = ParamViewer(txt_3)
viewer_14 = ParamViewer(txt_3)
panel_8 = Panel(txt_3)
# Simplify
# Simplify rimuove gli indici che non sono utili a definire la struttura dati (es. gli indici che rimangono fissi in tutto il tree).
# 
# Anche se cambiano i paths, la gerarchia tra gli elementi si conserva.
viewer_15 = ParamViewer(data_3)
panel_9 = Panel(data_3)
# A B C D
# E F G H
# I J K L
panel_10 = Panel(data_2)
# Flip Matrix
viewer_16 = ParamViewer(data_2)
viewer_17 = ParamViewer(data_2)
tstat = TreeStatistics(Tree=data_4)  # -> Paths, Length, Count
txt_4 = Text(graft(txt_3))
txt_5 = Text(flatten(txt))
graft = GraftTree(Tree=txt_3, IncludeEmptyLists=True, IncludeNullItems=True)
flatten = FlattenTree(Tree=txt, Path="{0}")
pshift = ShiftPaths(Data=txt_2, Offset=-1)
trim = TrimTree(Tree=txt_2, Depth=1)
panel_11 = Panel(tstat.Paths)
panel_12 = Panel(tstat.Length)
panel_13 = Panel(tstat.Count)
data_5 = Data(simplify(data_3))
viewer_18 = ParamViewer(txt_4)
simplify = SimplifyTree(Tree=data_3, Front=False)
viewer_19 = ParamViewer(txt_4)
panel_14 = Panel(txt_4)
flip = FlipMatrix(Data=data_2)
viewer_20 = ParamViewer(trim)
viewer_21 = ParamViewer(pshift)
viewer_22 = ParamViewer(trim)
viewer_23 = ParamViewer(pshift)
panel_15 = Panel(trim)
panel_16 = Panel(flatten)
viewer_24 = ParamViewer(txt_5)
panel_17 = Panel(pshift)
viewer_25 = ParamViewer(txt_5)
panel_18 = Panel(txt_5)
viewer_26 = ParamViewer(simplify)
panel_19 = Panel(simplify)
# A E I
# B F K
# C G K
# D H L
panel_20 = Panel(flip)
panel_21 = Panel(graft)
viewer_27 = ParamViewer(flip)
viewer_28 = ParamViewer(flip)
