# Grasshopper definition clipping plane animation.gh (Grasshopper 1.0.7)
# plug-ins: froGH

reverse_sequence = ValueList({"no": 0, "yes": 1}, selected="no")
section_plane = ValueList({"XY": 0, "XZ": 1, "YZ": 2, "custom": 3}, selected="XZ")
flip_plane = ValueList({"no": 0, "yes": 1}, selected="no")

# ----
# how to save the animation frames: Choose the Display Mode you prefer in the Rhino viewport, then, in the slider above:
# 
# right click > Animate...
# 
# Choose you options in the Animate controls panel - make sure the selected viewport is the one you want (check the preview as well) - when you press Ok the animation will start recording.
# 
# You will need a video making tool to convert the frames into a video.
# 
# Hints:
# 
# . for production videos use HD resolution (1920x1080) or 4K if your computer supports it
# . choose the number of frames wisely (25 frames/second > so a 10 seconds video requires 250 frames)
# . save frames in a dedicated folder (do not save directly to the Desktop unless you want to spend 2 hours deleting all the files that are created)
# . the extension you put in the Filename template sets the image format (.jpg or .png are preferred - .png is the one I suggest)
# make a Clipping Plane in Rhino and import it here. Any clipping plane will do, the orientation will be decided here in the definition.
animation_slider = Slider(0, range=0..1)
# convert frames into a video: My preferred choice for making videos from frames in an immediate way is to use Processing (free and cross platform):
# 
# . download Processing from https://processing.org/download/
# . unzip the downloaded file and run Processing
# . go to Tools > Movie Maker
# . just drag and drop the folder where you saved the frames, check that "original resolution" is selected, choose a filename and a destination folder and then just click Create Movie
# 
# Processing saves .mov video files
# 
# Processing is a programming environment so it sounds really counbter-intuitive to use it for video making task... but, apart from downloading it the first time, I found it to be the most immediate and easy way to convert frames into videos, especially if your only need is to have the video.
# 
# Saving to frames is a better option than saving directly a video, for many reasons. Just to name a couple:
# . if your computer crashes while exporting the frames you don't have to restart from scratch, you can just restart from the last saved one
# . you can decide where to start/stop the video just by putting the selected frames in a dedicated folder and then make the video from there
# 
# 
# Otherwise the options to convert frames into video may vary (just search on line), also depending on the editing level you want
id = Guid(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)

# ---- group: adjust these until the plane is out of sight
plane_y_dir = Slider(0, range=-2000..2000)
plane_x_dir = Slider(166.09, range=-2000..2000)

# ----
visualize_plane = BooleanToggle(True)
visualize_direction = BooleanToggle(True)
direction_display_length = Slider(15, range=0..100)

# ---- group: z
pt = Point(Point(0, 0, 1))

# ---- group: y
pt_2 = Point(Point(0, 1, 0))

# ---- group: x
pt_3 = Point(Point(1, 0, 0))

# ---- group: input custom vector here
vec = Vector(Vector(1, 3, -2))

# ---- group: import geometries
geo = Geometry([<mesh referenced from the Rhino model> x12])

# ----
filter = StreamFilter(Gate=section_plane, Stream0=pt, Stream1=pt_2, Stream2=pt_3, Stream3=vec)
rev = Reverse(Vector=filter)
filter_2 = StreamFilter(Gate=flip_plane, Stream0=filter, Stream1=rev)
pt_4 = Point(Point(0, 0, 0))
pl = PlaneNormal(Origin=pt_4, ZAxis=filter_2)
bbox = BoundingBox(Content=geo, Plane=pl, UnionBox=True)  # -> Box, Box_2
# Clipping plane animation
# 
# <description>
# 
# code by Alessio Erioli
# 
# v 0.1
# © Co-de-iT 2020 / Creative Commons Attribution-Non Commercial-ShareAlike 4.0 International License
# easing animation
graph = GraphMapper(
    animation_slider,
    x0=0,
    x1=1,
    y0=0,
    y1=1,
    container_name="Bezier",
    cpx=[0, 0, 0.9923480749, 1],
    cpy=[0, 0.413043499, 0.593565166, 1])
box = EvaluateBox(Box=bbox.Box, UParameter=0.5, VParameter=0.5, WParameter=0.5)  # -> Plane, Point, Include
num = Number(graph)
scale = Scale(Geometry=bbox.Box, Center=box.Point, Factor="1.2")  # -> Geometry, Transform
subtraction = Subtraction(A="1", B=num)
box_corners = BoxCorners(Box=scale.Geometry)  # -> CornerA, CornerB, CornerC, CornerD, CornerE, CornerF, CornerG, CornerH
filter_3 = StreamFilter(Gate=reverse_sequence, Stream0=num, Stream1=subtraction)
vec2pt = Vector2Pt(PointA=box_corners.CornerA, PointB=box_corners.CornerE, Unitize=False)  # -> Vector, Length
f_cdom = CenteredDomain(DomainLength=vec2pt.Length)
remap = RemapNumbers(Value=filter_3, Source=Domain(0, 1), Target=f_cdom)  # -> Mapped, Clipped
amp = Amplitude(Vector=vec2pt.Vector, Amplitude=remap.Mapped)
addition = Addition(A=box.Point, B=amp)
pl_origin = PlaneOrigin(Base=pl, Origin=addition)
filter_4 = StreamFilter(Gate=visualize_direction, Stream1=pl_origin)
deplane = DeconstructPlane(Plane=filter_4)  # -> Origin, XAxis, YAxis, ZAxis
xy = XYPlane(Origin=Point(0, 0, 0))
multiplication = Multiplication(A=deplane.ZAxis, B=direction_display_length)
pln = Plane(pl_origin)
orient = Orient(Geometry=bbox.Box, Source=pl, Target=xy)  # -> Geometry, Transform
boxprop = BoxProperties(Box=orient.Geometry)  # -> Center, Diagonal, Area, Volume, Degeneracy
multiplication_2 = Multiplication(A=boxprop.Diagonal, B=0.5)
devec = DeconstructVector(Vector=multiplication_2)  # -> XComponent, YComponent, ZComponent
pt_5 = PointOriented(BasePlane=pl_origin, UComponent=devec.XComponent, VComponent=devec.YComponent, WComponent=0)
vdisex = VectorDisplayEx(Point=pt_5, Vector=multiplication, Colour=ColourSwatch(SwatchColor=RGB(255, 0, 0)), Width=2)
deplane_2 = DeconstructPlane(Plane=pln)  # -> Origin, XAxis, YAxis, ZAxis
devec_2 = DeconstructVector(Vector=boxprop.Diagonal)  # -> XComponent, YComponent, ZComponent
amp_2 = Amplitude(Vector=deplane_2.YAxis, Amplitude=plane_y_dir)
amp_3 = Amplitude(Vector=deplane_2.XAxis, Amplitude=plane_x_dir)
f_cdom_2 = CenteredDomain(DomainLength=devec_2.YComponent)
f_cdom_3 = CenteredDomain(DomainLength=devec_2.XComponent)
amp_4 = Amplitude(Vector=deplane_2.ZAxis, Amplitude=Slider(-1, range=-1..0))
move = Move(Geometry=pln, Motion=amp_4)  # -> Geometry, Transform
addition_2 = Addition(A=deplane_2.Origin, B=amp_3, C=amp_2)
rectangle = Rectangle(Plane=pln, XSize=f_cdom_3, YSize=f_cdom_2, Radius=0)  # -> Rectangle, Length
pl_origin_2 = PlaneOrigin(Base=pln, Origin=addition_2)
c_script = CSharpScript(id=id, P=pl_origin_2)  # inputs id: Guid, P: Plane
# ---------- c_script: C# usings ----------
using System.IO;
using System.Linq;
using System.Data;
using System.Drawing;
using System.Reflection;
using System.Windows.Forms;
using System.Xml;
using System.Xml.Linq;
using System.Runtime.InteropServices;

using Rhino.DocObjects;
using Rhino.Collections;
using GH_IO;
using GH_IO.Serialization;
# ---------- c_script: C# ----------
    if (id == null) return;
    Rhino.DocObjects.ObjRef obj;
    if (Rhino.RhinoApp.ExeServiceRelease < 5)
      obj = new Rhino.DocObjects.ObjRef(id);
    else obj = new Rhino.DocObjects.ObjRef(doc, id);
    Rhino.DocObjects.ClippingPlaneObject cpObj = obj.Object() as Rhino.DocObjects.ClippingPlaneObject;
    cpObj.ClippingPlaneGeometry.Plane = P;
    cpObj.CommitChanges();
# ---------- end c_script ----------
scale_2 = Scale(Geometry=rectangle.Rectangle, Center=move.Geometry, Factor=Slider(1.5, range=1..2))  # -> Geometry, Transform
filter_5 = StreamFilter(Gate=visualize_plane, Stream1=scale_2.Geometry)

# ---- group: visualize plane as planar surface
boundary = BoundarySurfaces(Edges=filter_5)
