# Grasshopper definition inspect local density.gh (Grasshopper 1.0.7)
# Copyright: Co-de-iT
# plug-ins: Assembler, Human

assemblage = Relay()
ao_index = Slider(22, range=0..100)
aoatopo = ExtractTopology(Assemblage=assemblage)  # -> HandleOccupancy, NeighbourObjectIndex, NeighbourHandleIndex
# <title>
# 
# <description>
# 
# code by Alessio Erioli
# 
# v 0.1
# © a3 2021 / Creative Commons Attribution-Non Commercial-ShareAlike 4.0 International License
aoadecon = DeconstructAssemblage(Assemblage=assemblage)  # -> AssemblageObjects, AssemblageRules, ReceiverObjectsIndexes, AvailableObjectIndexes, UnreachableObjectIndexes
item = ListItem(List=flatten(aoadecon.AssemblageObjects), Index=ao_index, Wrap=True)
branch = TreeBranch(Tree=simplify(aoatopo.NeighbourObjectIndex), Path=ao_index, MaintainPaths=True)
aodecon = DeconstructAssemblyObject(AssemblyObject=item)  # -> Name, CollisionMesh, ReferencePlane, Direction, Handles, Weight, OccludedNeighbours, ZLock, ReceiverValue
item_2 = ListItem(List=aodecon.OccludedNeighbours, Index=0, Wrap=True)  # -> flatten(Item)
panel = Panel(aodecon.OccludedNeighbours)
item_3 = ListItem(List=flatten(aoadecon.AssemblageObjects), Index=item_2, Wrap=False)
item_4 = ListItem(List=flatten(aoadecon.AssemblageObjects), Index=branch, Wrap=False)
aoecmesh = ExtractCollisionMesh(AssemblyObject=item_4)
aoecmesh_2 = ExtractCollisionMesh(AssemblyObject=item_3)
merge = Merge(Data1=aodecon.CollisionMesh, Data2=aoecmesh_2, Data3=aoecmesh)  # -> flatten(Result)
preview = CustomPreview(Geometry=aodecon.CollisionMesh, Material=ColourSwatch(SwatchColor=RGB(255, 255, 255)))
bbox = BoundingBox(Content=merge, Plane=PlaneXY(0, 0, 0))  # -> Box, Box_2
bbox_2 = BoundingBox(Content=merge, Plane=PlaneXY(0, 0, 0), UnionBox=True)  # -> Box, Box_2
edges = BrepEdges(Brep=bbox_2.Box)  # -> Naked, Interior, NonManifold
edges_2 = BrepEdges(Brep=bbox.Box)  # -> Naked, Interior, NonManifold
medges = MeshEdges(Mesh=merge)  # -> NakedEdges, InteriorEdges, NonManifoldEdges

# ---- group: occluded neighbours
preview_2 = CustomPreview(Geometry=aoecmesh_2, Material=ColourSwatch(SwatchColor=RGBA(202, 94, 235, 62)))

# ---- group: connected neighbours
preview_3 = CustomPreview(Geometry=aoecmesh, Material=ColourSwatch(SwatchColor=RGBA(19, 209, 193, 148)))

# ----
previewlw = CustomPreviewLineweights(Geometry=[medges.NakedEdges, medges.InteriorEdges], Shader=ColourSwatch(SwatchColor=RGB(0, 0, 0)), Absolute=False)
previewlw_2 = CustomPreviewLineweights(Geometry=edges.Interior, Shader=ColourSwatch(SwatchColor=RGB(0, 0, 0)), Thickness="2", Absolute=False)
previewlw_3 = CustomPreviewLineweights(Geometry=edges_2.Interior, Shader=ColourSwatch(SwatchColor=RGB(255, 212, 0)), Thickness="2", Absolute=False)
